# Grasshopper definition example_zac.ghx (Grasshopper 1.0.7)

# Visualization
panel = Panel("data\master_navigation_data.json")
# FreeDrive
number_slider = Slider(-200, range=-300..100)
# FileStructure
data_folder_name = Panel("data")
construct_point = ConstructPoint(XCoordinate=number_slider, YCoordinate=Slider(-200, range=-401..0), ZCoordinate=0)
relative_path = GhPythonScript(RelativeDir=panel)  # -> Dir
# ---------- relative_path: Python ----------
import os

path = ghenv.Component.OnPingDocument().FilePath
Dir = os.path.join(os.path.dirname(path),RelativeDir)

print Dir

ghenv.Component.Message = "Location:"+str(Dir)
# ---------- end relative_path ----------

free_drive = BooleanToggle(False)
toggle_freedrive = GhPythonScript(free_drive=free_drive, NAVIGATION_JSON=relative_path)  # -> out
# ---------- toggle_freedrive: Python ----------
import os
from compas.rpc import Proxy

import json
with open(NAVIGATION_JSON, "r") as f:
    data = json.load(f)
ip = data["ip"]

if free_drive:   
    canvas = ghenv.Component.OnPingDocument()
    path = os.path.abspath(os.path.dirname(canvas.FilePath))
    rtde = Proxy('data.rtde_wrapper', path=path)                         # stay in teach moded(freedrive) as long as this is True
    a = rtde.start_teach_mode(ip=ip)            # send message to robot
    ghenv.Component.Message = "Freedrive on"    # display message on GH component
else:   
    canvas = ghenv.Component.OnPingDocument()
    path = os.path.abspath(os.path.dirname(canvas.FilePath))
    rtde = Proxy('data.rtde_wrapper', path=path)                          # stop teach mode if stop button pressed
    a = rtde.stop_teach_mode(ip=ip)             # send message to robot   
    ghenv.Component.Message = "Freedrive off"   # display message on GH component
# ---------- end toggle_freedrive ----------

relative_path_2 = GhPythonScript()  # -> Dir
# ---------- relative_path_2: Python ----------
import os

path = ghenv.Component.OnPingDocument().FilePath
Dir = os.path.dirname(path)

print Dir

ghenv.Component.Message = "Location:"+str(Dir)
# ---------- end relative_path_2 ----------
data = Data(data_folder_name)
fabricate = Button()
xy_plane = XYPlane(Origin=Point(0, 0, 0))
python = GhPythonScript(NAVIGATION_JSON=relative_path, fabricate=fabricate, debug_plane=xy_plane)  # -> out, script; inputs fabricate: Boolean, debug_plane: Plane
# ---------- python: Python ----------
from imp import reload
import Rhino.Geometry as rg
import simple_ur_script as ur
# reload(ur)
import simple_comm as c
import json
# reload(c)

def tcp(script):
    script += ur.set_tcp_by_angles(TCP[0], TCP[1], TCP[2], TCP[3], TCP[4], TCP[5])
    return script

def set_robot_base():
    pt_0 = rg.Point3d(origin[0], origin[1],origin[2])# base plane origin
    pt_1 = rg.Point3d(origin_x[0], origin_x[1],origin_x[2])
    pt_2 = rg.Point3d(origin_y[0], origin_y[1],origin_y[2])
    robot_base = rg.Plane(pt_0, pt_1 - pt_0, pt_2 - pt_0)
    return robot_base

def rhino_to_robot_space(rhino_plane):
    plane = rhino_plane.Clone()
    robot_base_plane = set_robot_base()
    rhino_matrix = rg.Transform.PlaneToPlane(rg.Plane.WorldXY, robot_base_plane)
    plane.Transform(rhino_matrix)
    return plane

def send(script):
    script = c.concatenate_script(script)
    c.send_script(script, IP_ADDRESS)
    return script

path =NAVIGATION_JSON

with open(path, "r") as f:
    data = json.load(f)

origin = data["origin"]
origin_x = data["origin_x"]
origin_y = data["origin_y"]
TCP = data["tcp"]
Z_OFFSET = data["offset_z"]
IP_ADDRESS = data["ip"]  # string with IP Address

test_plane = debug_plane.Clone()
MAX_SPEED = .1
MAX_ACCEL = .1
# the_stop_plane = stop_plane.Clone()
# stop_configurations.reverse()

script = ""
script = tcp(script)


script += ur.move_l(rhino_to_robot_space(test_plane), MAX_ACCEL, MAX_SPEED)
    

if fabricate:
    send(script)
# ---------- end python ----------
panel_2 = Panel(toggle_freedrive)
# Design
geometry = Geometry([<curve referenced from the Rhino model> x2])
geometry_2 = Geometry(<curve referenced from the Rhino model>)
list_item = ListItem(List=geometry, Index=0, Wrap=True)  # -> Item, Item1
sweep2 = Sweep2(Rail1=list_item.Item, Rail2=list_item.Item1, Sections=geometry_2, SameHeight=False)
geometry_3 = Geometry([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])
contour = Contour(Shape=sweep2, Point=Point(0, 0, 0), Direction=Vector(0, 0, 1), Distance=Slider(7, range=0..10))  # -> flatten(Contours)
divide_curve = DivideCurve(Curve=contour, Count=Slider(100, range=0..100), Kinks=False)  # -> flatten(Points), Tangents, Parameters
list_length = ListLength(List=contour)
ghpython_script = GhPythonScript(path=relative_path_2, folder_name=data, file_name="out_printpoints.json")  # -> path
# ---------- ghpython_script: Python ----------
a = ghdoc.Path

path =path + '\\' + folder_name + '\\output\\'+  file_name
# ---------- end ghpython_script ----------
point = Point(Point(-58.28972138, -279.5472059, 0))
plane = Plane(divide_curve.Points)
plane_2 = Plane(point)

# ----
# Ligthweight Path Visualization
all_points = Point(plane_2)
list_length_2 = ListLength(List=all_points)
repeat_data = RepeatData(Data=True, Length=list_length_2)
extruder_toggles = Number(repeat_data)
cslightpathviz = CsLightPathViz(points=all_points, extruder_toggles=extruder_toggles, pipe_diameter=Slider(2, range=0..10))  # -> out, print_path_pipes, travel_path_lines; inputs points: list of Point3d, extruder_toggles: list of Boolean
# ---------- cslightpathviz: Python ----------
"""
Creates a lightweight visualization of the print paths. Segments with extruder_toggle=True are visualized as pipes, 
segments with extruder_toggle=False are visualized as lines.
Loads files from the 'output' folder.

"""

import compas_slicer_ghpython.visualization as gh_compas_slicer
gh_compas_slicer = reload(gh_compas_slicer)

pipe_resolution = 14

if points:
    
    # assign default values to parameters where possible. 
    if not extruder_toggles:
        extruder_toggles = [False for i in range(len(points))]
    if not pipe_diameter:
        pipe_diameter = 2.0
        
    print_path_pipes, travel_path_lines = \
        gh_compas_slicer.lightweight_path_visualization(points, extruder_toggles, pipe_diameter, pipe_resolution)
    
else:
    gh_compas_slicer.missing_input()
# ---------- end cslightpathviz ----------

print_planes = Plane(all_points)
tool_mesh = Mesh(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)

# ----
# Tool Visualization
number_slider_2 = Slider(62, range=-1..2000)
tool_origin = Panel("""0
0
99.507""")
cstoolviz = CsToolViz(origin_coords=tool_origin, mesh=tool_mesh, planes=print_planes, index=number_slider_2)  # -> out, mesh, passed_path; inputs origin_coords: list, mesh: Mesh, planes: list, index: Int32
# ---------- cstoolviz: Python ----------
"""
Example visualization of tool motion during the print.

"""

import compas_slicer_ghpython.visualization as gh_compas_slicer
gh_compas_slicer = reload(gh_compas_slicer)

if origin_coords and mesh and planes and (index or index==0):
    mesh, passed_path = gh_compas_slicer.tool_visualization(origin_coords, mesh, planes, index)
else:
    gh_compas_slicer.missing_input()
# ---------- end cstoolviz ----------

mesh = Mesh(cstoolviz.mesh)
geo = Geometry(cstoolviz.passed_path)
preview = CustomPreview(Geometry=mesh, Material=ColourSwatch(SwatchColor=RGB(171, 171, 171)))
preview_2 = CustomPreview(Geometry=geo, Material=ColourSwatch(SwatchColor=RGB(255, 156, 36)))

# ---- group: Color output
geo_2 = Geometry(cslightpathviz.travel_path_lines)
geo_3 = Geometry(cslightpathviz.print_path_pipes)
preview_3 = CustomPreview(Geometry=geo_3, Material=ColourSwatch(SwatchColor=RGB(199, 199, 199)))
preview_4 = CustomPreview(Geometry=geo_2, Material=ColourSwatch(SwatchColor=RGB(255, 156, 36)))

# ----
ghpython_script_2 = GhPythonScript(planes=plane_2)  # -> compasFrames; inputs planes: list
# ---------- ghpython_script_2: Python ----------
from compas_rhino.conversions import plane_to_compas_frame

compasFrames = []
for p in planes:
    compasFrames.append(plane_to_compas_frame(p))
# ---------- end ghpython_script_2 ----------
to_json = ToJSON(data=ghpython_script_2, filepath=ghpython_script, pretty=Toggle(True))  # -> json; inputs data: list, pretty: Boolean
#   port data: COMPAS data objects to serialize.
#   port filepath: File path where to store the JSON file. If empty, it will not store to disk but instead return the JSON string.
#   port pretty: If True, JSON data will be formatted with indentation and key sorting.
#   port json: JSON file path or JSON string.
# ---------- to_json: Python ----------
"""
Serializes COMPAS objects to JSON.
"""
from ghpythonlib.componentbase import executingcomponent as component

import compas


class CompasInfo(component):
    def RunScript(self, data, filepath, pretty):
        json = filepath

        if filepath:
            compas.json_dump(data, filepath, pretty)
        else:
            json = compas.json_dumps(data, pretty)

        return json
# ---------- end to_json ----------
number = Number(list_length)

ghpython_script_3 = GhPythonScript(planes=plane_2, layerNumber=number, ratio=Slider(0.95, range=0..1))  # -> Radii; inputs planes: list
# ---------- ghpython_script_3: Python ----------
Radii = []
for i,p in enumerate(planes):
    if i == 0: Radii.append(0)
    elif i == len(planes)-1: Radii.append(ratio*p.Origin.DistanceTo(planes[i-1].Origin)/2)
    else:
        Radii.append(ratio*min(p.Origin.DistanceTo(planes[i-1].Origin),p.Origin.DistanceTo(planes[i+1].Origin))/2)
        

#for i in range(len(Radii)): 
#    if Radii[i]<0.7: Radii[i] = 0
#    if Radii[i]>0.7 and Radii[i]<1: Radii[i] = 1.1


for i in range(len(Radii)): 
    if Radii[i]<1: Radii[i] = 1
    if i == layerNumber or i == layerNumber+1: Radii[i] = 0
# ---------- end ghpython_script_3 ----------
ghpython_script_4 = GhPythonScript(path=relative_path_2, folder_name=data, file_name="out_printpoints_radii.json")  # -> path; same code as ghpython_script
to_json_2 = ToJSON(data=ghpython_script_3, filepath=ghpython_script_4, pretty=Toggle(True))  # -> json; inputs data: list, pretty: Boolean; same code as to_json

panel_3 = Panel(to_json)
panel_4 = Panel(to_json_2)
