# Grasshopper definition zac.ghx (Grasshopper 1.0.7)
# plug-ins: Pufferfish

crv = Curve([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])
strength = Slider(0.893, range=-1..1)
radius = Slider(1218.146, range=0..2000)
bbox = BoundingBox(Content=crv, Plane=PlaneXY(0, 0, 0), UnionBox=True)  # -> Box, Box_2
pop3d = Populate3D(Region=bbox.Box, Count=Slider(12, range=0..100), Seed=1)
divide = DivideCurve(Curve=crv, Count=Slider(7, range=0..100), Kinks=False)  # -> Points, Tangents, Parameters
range = Range(Domain=Domain(0, 1), Steps=Slider(75, range=0..100))
graph = GraphMapper(
    range,
    x0=0,
    x1=1,
    y0=0,
    y1=1,
    container_name="Sine",
    Equation_px=[0.001739059691, 0.1536232829],
    Equation_py=[0.2263767123, 0.807246089])
item = ListItem(List=reverse(divide.Points), Index=0, Wrap=True)
relative_dir = Panel("xx")
panel = Panel("C:\Users\Zac\Desktop")
read_file = ReadFile(PerLineParse=False)
item_2 = ListItem(List=divide.Points, Index=0, Wrap=True)
merge = Merge(Data1=item_2, Data2=item)
base_surfaces = Surface([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])
base_surface = Surface(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)
base_surface_2 = Surface(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)
base_surface_3 = Surface(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)
ghpython_script = GhPythonScript()  # -> Out, OutTemp
_0_to_1_00 = Slider(0, range=0..1)
_1_to_100 = Slider(0, range=0..100)
linearnums = LinearizeNumbers(Numbers=graph, Domain=Domain(0, 1))  # -> Linearized, Actual, Original
relative_path = GhPythonScript(RelativeDir=relative_dir)  # -> Dir
# ---------- relative_path: Python ----------
import os

path = ghenv.Component.OnPingDocument().FilePath
Dir = os.path.join(os.path.dirname(path),RelativeDir)

print Dir

ghenv.Component.Message = "Location:"+str(Dir)
# ---------- end relative_path ----------
srf = Surface([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])
xz_plane = XZPlane(Origin=Point(0, 0, 0))
p_n_s = PinchNSpreadPoints(
    Points=divide.Points,
    Locations=pop3d,
    Radii=radius,
    Strengths=strength,
    Falloffs=Slider(0.329, range=0..1),
    Exponents=Slider(10, range=0..10),
    Weights1=Slider(0.675, range=0..1),
    Weights2=Slider(0.342, range=0..1),
    Anchors=merge)
tboxthrusrfs = TwistedBoxThroughSurfaces(
    Surfaces=srf,
    ParametersU=[0, 0.25, 0.5, 0.75, 1],
    ParametersV=[0, 0.25, 0.5, 0.75, 1],
    ParametersW=linearnums.Linearized,
    Normalized=True,
    Equalized=False,
    Weighted=False,
    Loopback=False,
    Degree=3,
    InterpolationType=Slider(3, range=0..10),
    Refit=0,
    PointSample=0)
netsrf = NetOnSurface(Surface=base_surface_3, CountU=Slider(30, range=0..100), CountV=Slider(4, range=0..100), Flip=Toggle(False))
netsrf_2 = NetOnSurface(Surface=base_surface_2, CountU=Slider(30, range=0..100), CountV=Slider(4, range=0..100), Flip=Toggle(False))
netsrf_3 = NetOnSurface(Surface=base_surface, CountU=Slider(30, range=0..100), CountV=Slider(4, range=0..100), Flip=Toggle(False))
netsrf_4 = NetOnSurface(Surface=base_surfaces, CountU=Slider(14, range=0..100), CountV=Slider(3, range=0..100), Flip=Toggle(False))
c_script = CSharpScript()  # -> Out, A

preview = CustomPreview(Geometry=netsrf_2, Shader=ColourSwatch(SwatchColor=RGB(247, 255, 0)))

rotate = Rotate(Geometry=netsrf, Angle=1.570796327, Plane=xz_plane)  # -> Geometry, Transform
nurbs = NurbsCurve(Vertices=p_n_s, Degree=3, Periodic=False)  # -> Curve, Length, Domain
preview_2 = CustomPreview(Geometry=tboxthrusrfs, Shader=ColourSwatch(SwatchColor=RGB(0, 72, 255)))
preview_3 = CustomPreview(Geometry=netsrf_3, Shader=ColourSwatch(SwatchColor=RGB(74, 227, 0)))
preview_4 = CustomPreview(Geometry=netsrf_4, Shader=ColourSwatch(SwatchColor=RGB(255, 255, 195)))
preview_5 = CustomPreview(Geometry=nurbs.Curve, Shader=ColourSwatch(SwatchColor=RGB(0, 229, 255)))

preview_6 = CustomPreview(Geometry=rotate.Geometry, Shader=ColourSwatch(SwatchColor=RGB(0, 255, 238)))
