# Grasshopper definition blendingConnector.ghx (Grasshopper 1.0.7)

relative_dir = Panel("xx")
panel = Panel("C:\Users\Zac\Desktop")
read_file = ReadFile(PerLineParse=False)
_0_to_1_00 = Slider(0, range=0..1)
_1_to_100 = Slider(0, range=0..100)
relative_path = GhPythonScript(RelativeDir=relative_dir)  # -> Dir
# ---------- relative_path: Python ----------
import os

path = ghenv.Component.OnPingDocument().FilePath
Dir = os.path.join(os.path.dirname(path),RelativeDir)

print Dir

ghenv.Component.Message = "Location:"+str(Dir)
# ---------- end relative_path ----------
c_script = CSharpScript()  # -> Out, A
ghpython_script = GhPythonScript()  # -> Out, OutTemp
