# Grasshopper definition lashings test.gh (Grasshopper 1.0.7)

geo = Geometry(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)
geo_2 = Geometry(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)
geo_3 = Geometry(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)
geo_4 = Geometry(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)
geo_5 = Geometry(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)

geo_6 = Geometry(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)
geo_7 = Geometry(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)

eval = EvaluateCurve(Curve=reparameterize(geo_7), Parameter=Slider(0.42, range=0..1))  # -> Point, Tangent, Angle
eval_2 = EvaluateCurve(Curve=reparameterize(geo_5), Parameter=Slider(0.31, range=0..1))  # -> Point, Tangent, Angle
scale = Scale(Geometry=geo_7, Center=eval.Point, Factor=Slider(0.03, range=0..1))  # -> Geometry, Transform
scale_2 = Scale(Geometry=geo_5, Center=eval_2.Point, Factor=Slider(0.03, range=0..1))  # -> Geometry, Transform

eval_3 = EvaluateCurve(Curve=reparameterize(geo), Parameter=Slider(0.63, range=0..1))  # -> Point, Tangent, Angle
eval_4 = EvaluateCurve(Curve=reparameterize(geo_2), Parameter=Slider(0.56, range=0..1))  # -> Point, Tangent, Angle
eval_5 = EvaluateCurve(Curve=reparameterize(geo_3), Parameter=Slider(0.66, range=0..1))  # -> Point, Tangent, Angle
scale_3 = Scale(Geometry=geo_2, Center=eval_4.Point, Factor=Slider(0.03, range=0..1))  # -> Geometry, Transform
scale_4 = Scale(Geometry=geo, Center=eval_3.Point, Factor=Slider(0.03, range=0..1))  # -> Geometry, Transform
scale_5 = Scale(Geometry=geo_3, Center=eval_5.Point, Factor=Slider(0.03, range=0..1))  # -> Geometry, Transform

eval_6 = EvaluateCurve(Curve=reparameterize(geo_6), Parameter=Slider(0.42, range=0..1))  # -> Point, Tangent, Angle
eval_7 = EvaluateCurve(Curve=reparameterize(geo_4), Parameter=Slider(0.5, range=0..1))  # -> Point, Tangent, Angle
scale_6 = Scale(Geometry=geo_6, Center=eval_6.Point, Factor=Slider(0.03, range=0..1))  # -> Geometry, Transform
scale_7 = Scale(Geometry=geo_4, Center=eval_7.Point, Factor=Slider(0.03, range=0..1))  # -> Geometry, Transform

eval_8 = EvaluateCurve(Curve=reparameterize(geo_3), Parameter=Slider(0.15, range=0..1))  # -> Point, Tangent, Angle
eval_9 = EvaluateCurve(Curve=reparameterize(geo_4), Parameter=Slider(0.89, range=0..1))  # -> Point, Tangent, Angle
eval_10 = EvaluateCurve(Curve=reparameterize(geo_5), Parameter=Slider(0.71, range=0..1))  # -> Point, Tangent, Angle
scale_8 = Scale(Geometry=geo_3, Center=eval_8.Point, Factor=Slider(0.03, range=0..1))  # -> Geometry, Transform
scale_9 = Scale(Geometry=geo_4, Center=eval_9.Point, Factor=Slider(0.03, range=0..1))  # -> Geometry, Transform
scale_10 = Scale(Geometry=geo_5, Center=eval_10.Point, Factor=Slider(0.03, range=0..1))  # -> Geometry, Transform

number_slider = Slider(8, range=0..10)
pipe = Pipe(Curve=[geo_2, geo, geo_3, geo_4, geo_5, geo_6, geo_7], Radius=number_slider, Caps=1)
preview = CustomPreview(Geometry=pipe, Material=ColourSwatch(SwatchColor=RGBA(204, 82, 82, 145)))
number_slider_2 = Slider(2, range=0..10)

number_slider_3 = Slider(10, range=0..10)
number_slider_4 = Slider(9, range=0..10)
pipe_2 = Pipe(Curve=scale_9.Geometry, Radius=number_slider_3, Caps=1)
pipe_3 = Pipe(Curve=scale_10.Geometry, Radius=number_slider_3, Caps=1)
pipe_4 = Pipe(Curve=scale_8.Geometry, Radius=number_slider_3, Caps=1)
popgeo = PopulateGeometry(Geometry=pipe_4, Count=number_slider_2, Seed=Slider(9, range=0..10))
popgeo_2 = PopulateGeometry(Geometry=pipe_2, Count=number_slider_2, Seed=number_slider_4)
popgeo_3 = PopulateGeometry(Geometry=pipe_3, Count=number_slider_2, Seed=Slider(9, range=0..10))
number_slider_5 = Slider(3, range=0..10)
prox = Proximity3D(Points=[popgeo_2, popgeo_3, popgeo], Group=number_slider_5, MinRadius=number_slider)  # -> Links, Topology

number_slider_6 = Slider(10, range=0..10)
pipe_5 = Pipe(Curve=scale_2.Geometry, Radius=number_slider_6, Caps=1)
pipe_6 = Pipe(Curve=scale.Geometry, Radius=number_slider_6, Caps=1)
popgeo_4 = PopulateGeometry(Geometry=pipe_5, Count=number_slider_2, Seed=Slider(3, range=0..10))
popgeo_5 = PopulateGeometry(Geometry=pipe_6, Count=number_slider_2, Seed=number_slider_4)
prox_2 = Proximity3D(Points=[popgeo_5, popgeo_4], Group=number_slider_5, MinRadius=number_slider)  # -> Links, Topology

number_slider_7 = Slider(9, range=0..10)
pipe_7 = Pipe(Curve=scale_6.Geometry, Radius=number_slider_7, Caps=1)
pipe_8 = Pipe(Curve=scale_7.Geometry, Radius=number_slider_7, Caps=1)
popgeo_6 = PopulateGeometry(Geometry=pipe_7, Count=number_slider_2, Seed=number_slider_4)
popgeo_7 = PopulateGeometry(Geometry=pipe_8, Count=number_slider_2, Seed=number_slider_4)
prox_3 = Proximity3D(Points=[popgeo_6, popgeo_7], Group=number_slider_5, MinRadius=number_slider)  # -> Links, Topology

number_slider_8 = Slider(10, range=0..10)
pipe_9 = Pipe(Curve=scale_5.Geometry, Radius=number_slider_8, Caps=1)
pipe_10 = Pipe(Curve=scale_3.Geometry, Radius=number_slider_8, Caps=1)
pipe_11 = Pipe(Curve=scale_4.Geometry, Radius=number_slider_8, Caps=1)
popgeo_8 = PopulateGeometry(Geometry=pipe_11, Count=number_slider_2, Seed=Slider(7, range=0..10))
popgeo_9 = PopulateGeometry(Geometry=pipe_9, Count=number_slider_2, Seed=Slider(1, range=0..10))
popgeo_10 = PopulateGeometry(Geometry=pipe_10, Count=number_slider_2, Seed=Slider(9, range=0..10))
prox_4 = Proximity3D(Points=[popgeo_10, popgeo_8, popgeo_9], Group=Slider(3, range=0..10), MinRadius=number_slider)  # -> Links, Topology

pipe_12 = Pipe(Curve=[prox_4.Links, prox.Links, prox_3.Links], Radius=Slider(1, range=0..10), Caps=1)

geometry = Geometry(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)

number_slider_9 = Slider(0.04, range=0..1)

scale_11 = Scale(Geometry=geo_2, Center=eval_4.Point, Factor=number_slider_9)  # -> Geometry, Transform
scale_12 = Scale(Geometry=geo, Center=eval_3.Point, Factor=number_slider_9)  # -> Geometry, Transform
scale_13 = Scale(Geometry=geo_3, Center=eval_5.Point, Factor=number_slider_9)  # -> Geometry, Transform

scale_14 = Scale(Geometry=geo_5, Center=eval_10.Point, Factor=number_slider_9)  # -> Geometry, Transform
scale_15 = Scale(Geometry=geo_4, Center=eval_9.Point, Factor=number_slider_9)  # -> Geometry, Transform
scale_16 = Scale(Geometry=geo_3, Center=eval_8.Point, Factor=number_slider_9)  # -> Geometry, Transform

scale_17 = Scale(Geometry=geo_6, Center=eval_6.Point, Factor=number_slider_9)  # -> Geometry, Transform
scale_18 = Scale(Geometry=geo_4, Center=eval_7.Point, Factor=number_slider_9)  # -> Geometry, Transform

scale_19 = Scale(Geometry=geo_7, Center=eval.Point, Factor=number_slider_9)  # -> Geometry, Transform

pipe_13 = Pipe(
    Curve=[scale_11.Geometry, scale_12.Geometry, scale_13.Geometry, scale_15.Geometry, scale_14.Geometry, scale_16.Geometry, scale_17.Geometry, scale_18.Geometry, scale_19.Geometry],
    Radius=number_slider_8,
    Caps=1)

preview_2 = CustomPreview(Geometry=[pipe_13, pipe_12], Material=ColourSwatch(SwatchColor=RGB(82, 184, 204)))
