# Grasshopper definition temp.gh (Grasshopper 1.0.7)

number_slider = Slider(1, range=0..1)
number_slider_2 = Slider(10, range=0..10)
geometry = Geometry([<brep referenced from the Rhino model> x40])
list_item = ListItem(List=geometry, Index=Slider(23, range=0..100), Wrap=True)
relative_dir = Panel("xx")
panel = Panel("C:\Users\Zac\Desktop")
read_file = ReadFile(PerLineParse=False)
ghpython_script = GhPythonScript()  # -> Out, OutTemp
_0_to_1_00 = Slider(0, range=0..1)
_1_to_100 = Slider(0, range=0..100)
contour = Contour(Shape=list_item, Point=Point(0, 0, 0), Direction=Vector(0, 0, 1), Distance=Slider(200, range=0..1000))
relative_path = GhPythonScript(RelativeDir=relative_dir)  # -> Dir
# ---------- relative_path: Python ----------
import os

path = ghenv.Component.OnPingDocument().FilePath
Dir = os.path.join(os.path.dirname(path),RelativeDir)

print Dir

ghenv.Component.Message = "Location:"+str(Dir)
# ---------- end relative_path ----------
c_script = CSharpScript()  # -> Out, A
path_mapper = PathMapper(contour, source="{a;b}", target="{a}")
list_item_2 = ListItem(List=path_mapper, Index=0, Wrap=True)  # -> Item1, Item
number_slider_3 = Slider(400, range=0..1000)
area = Area(Geometry=list_item_2.Item1)  # -> Area, Centroid
construct_point = ConstructPoint(XCoordinate=0, YCoordinate=0, ZCoordinate=0)
rectangular = Rectangular(
    Plane=PlaneXY(0, 0, 0),
    SizeX=number_slider_3,
    SizeY=number_slider_3,
    ExtentX=Slider(9, range=0..10),
    ExtentY=Slider(3, range=0..10))  # -> Cells, Points
sort_list = SortList(Keys=flatten(area.Area), ValuesA=flatten(list_item))  # -> Keys, ValuesA
sort_list_2 = SortList(Keys=flatten(area.Area), ValuesValuesA=flatten(list_item_2.Item))  # -> Keys, ValuesValuesA
area_2 = Area(Geometry=sort_list_2.ValuesValuesA)  # -> Area, Centroid
vector_2pt = Vector2Pt(PointA=flatten(area_2.Centroid), PointB=flatten(construct_point), Unitize=False)  # -> Vector, Length
move = Move(Geometry=sort_list.ValuesA, Motion=vector_2pt.Vector)  # -> Geometry, Transform
number_slider_4 = Slider(0.001, range=0..0.001)
number_slider_5 = Slider(5, range=0..10)
brep_wireframe = BrepWireframe(Brep=move.Geometry, Density=Slider(0.1, range=0..0.1))
curve_display = CurveDisplay(Curve=brep_wireframe, Width=Slider(1, range=0..1), Colour=ColourSwatch(SwatchColor=RGB(255, 255, 255)))  # inputs Curve: Curve, Width: Int32, Colour: Color, Dash: String
# ---------- curve_display: C# ----------
    if (Curve == null) return;
    if (Width <= 0) return;

    double[] pattern = ParseDashPattern(Dash);
    IEnumerable<Curve> segments = ApplyDashPattern(Curve, pattern);

    _clip = BoundingBox.Union(_clip, Curve.GetBoundingBox(false));
    foreach (Curve segment in segments)
    {
      _curves.Add(segment);
      _colors.Add(Colour);
      _widths.Add(Width);
    }
# ---------- curve_display: C# additional code ----------
  /// <summary>
  /// Parse a dash pattern.
  /// </summary>
  /// <param name="pattern">Pattern to parse.</param>
  /// <returns>Array of dashes and gaps.</returns>
  private double[] ParseDashPattern(string pattern)
  {
    if (string.IsNullOrWhiteSpace(pattern))
      return null;

    string[] fragments = pattern.Split(new char[] {' '});
    if (fragments == null || fragments.Length == 0)
      return null;

    double[] values = new double[fragments.Length];
    for (int i = 0; i < fragments.Length; i++)
    {
      double v;
      if (!double.TryParse(fragments[i], out v))
        throw new Exception(fragments[i] + " is a not a valid number.");

      if (v <= 0.0)
        throw new Exception("Dashes or gaps must have a strictly positive length.");

      values[i] = v;
    }

    return values;
  }
  /// <summary>
  /// Apply a dash+gap pattern to a curve.
  /// </summary>
  private IEnumerable<Curve> ApplyDashPattern(Curve curve, double[] pattern)
  {
    if (pattern == null || pattern.Length == 0)
      return new Curve[] { curve };

    double curveLength = curve.GetLength();
    List<Curve> dashes = new List<Curve>();

    double offset0 = 0.0;
    int index = 0;
    while(true)
    {
      // Get the current dash length.
      double dashLength = pattern[index++];
      if (index >= pattern.Length)
        index = 0;

      // Compute the offset of the current dash from the curve start.
      double offset1 = offset0 + dashLength;
      if (offset1 > curveLength)
        offset1 = curveLength;

      // Solve the curve parameters at the current dash start and end.
      double t0, t1;
      curve.LengthParameter(offset0, out t0);
      curve.LengthParameter(offset1, out t1);

      Curve dash = curve.Trim(t0, t1);
      if (dash != null)
        dashes.Add(dash);

      // Get the current gap length.
      double gapLength = pattern[index++];
      if (index >= pattern.Length)
        index = 0;

      // Set the start of the next dash to be the end of the current
      // dash + the length of the adjacent gap.
      offset0 = offset1 + gapLength;

      // Abort when we've reached the end of the curve.
      if (offset0 >= curveLength)
        break;
    }

    return dashes;
  }

  private BoundingBox _clip;
  private readonly List<Curve> _curves = new List<Curve>();
  private readonly List<Color> _colors = new List<Color>();
  private readonly List<int> _widths = new List<int>();

  /// <summary>
  /// This method will be called once every solution, before any calls to RunScript.
  /// </summary>
  public override void BeforeRunScript()
  {
    _clip = BoundingBox.Empty;
    _curves.Clear();
    _colors.Clear();
    _widths.Clear();
  }

  /// <summary>
  /// Return a BoundingBox that contains all the geometry you are about to draw.
  /// </summary>
  public override BoundingBox ClippingBox
  {
    get { return _clip; }
  }
  /// <summary>
  /// Draw all wires and points in this method.
  /// </summary>
  public override void DrawViewportWires(IGH_PreviewArgs args)
  {
    for (int i = 0; i < _curves.Count; i++)
      args.Display.DrawCurve(_curves[i], _colors[i], _widths[i]);
  }
# ---------- end curve_display ----------
