# Grasshopper definition test_2.ghx (Grasshopper 1.0.7)
# plug-ins: Pufferfish

geometry = Geometry([<curve referenced from the Rhino model> x12])
geometry_2 = Geometry([<curve referenced from the Rhino model> x12])
list_item = ListItem(List=geometry, Index=0, Wrap=True)  # -> Item, Item1, Item2, Item3, Item4, Item5, Item6, Item7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
geometry_3 = Geometry(list_item.Item)
geometry_4 = Geometry(list_item.Item1)
geometry_5 = Geometry(list_item.Item2)
geometry_6 = Geometry(list_item.Item3)
geometry_7 = Geometry(list_item.Item4)
geometry_8 = Geometry(list_item.Item5)
geometry_9 = Geometry(list_item.Item6)
geometry_10 = Geometry(list_item.Item7)
geometry_11 = Geometry(list_item.Item8)
geometry_12 = Geometry(list_item.Item9)
geometry_13 = Geometry(list_item.Item10)
geometry_14 = Geometry(list_item.Item11)
point_on_curve = PointOnCurve(geometry, parameter=0)
edge_surface = EdgeSurface(CurveA=geometry_3, CurveB=geometry_4, CurveC=geometry_5, CurveD=geometry_6)
edge_surface_2 = EdgeSurface(CurveA=geometry_7, CurveB=geometry_8, CurveC=geometry_9, CurveD=geometry_10)
edge_surface_3 = EdgeSurface(CurveA=geometry_6, CurveB=geometry_10, CurveC=geometry_11, CurveD=geometry_12)
edge_surface_4 = EdgeSurface(CurveA=geometry_4, CurveB=geometry_8, CurveC=geometry_13, CurveD=geometry_14)
edge_surface_5 = EdgeSurface(CurveA=geometry_3, CurveB=geometry_12, CurveC=geometry_7, CurveD=geometry_13)
edge_surface_6 = EdgeSurface(CurveA=geometry_5, CurveB=geometry_11, CurveC=geometry_9, CurveD=geometry_14)
parameter_surface_isocurve = ParameterSurfaceIsocurve(Surface=reparameterize(edge_surface_5), Parameter="1/3", Direction=False)
parameter_surface_isocurve_2 = ParameterSurfaceIsocurve(Surface=reparameterize(edge_surface_5), Parameter="2/3", Direction=False)
parameter_surface_isocurve_3 = ParameterSurfaceIsocurve(Surface=reparameterize(edge_surface_6), Parameter="1/3", Direction=Toggle(True))
parameter_surface_isocurve_4 = ParameterSurfaceIsocurve(Surface=reparameterize(edge_surface_6), Parameter="2/3", Direction=True)
parameter_surface_isocurve_5 = ParameterSurfaceIsocurve(Surface=reparameterize(edge_surface), Parameter="1/3", Direction=Toggle(False))
parameter_surface_isocurve_6 = ParameterSurfaceIsocurve(Surface=reparameterize(edge_surface), Parameter="2/3", Direction=Toggle(False))
parameter_surface_isocurve_7 = ParameterSurfaceIsocurve(Surface=reparameterize(edge_surface_2), Parameter="2/3", Direction=Toggle(True))
parameter_surface_isocurve_8 = ParameterSurfaceIsocurve(Surface=reparameterize(edge_surface_2), Parameter="1/3", Direction=Toggle(True))
construct_domain = ConstructDomain(DomainStart=Slider(0.13, range=0..1), DomainEnd=Slider(0.91, range=0..1))
construct_domain_2 = ConstructDomain(DomainStart=Slider(0.28, range=0..1), DomainEnd=Slider(0.71, range=0..1))
edge_surface_7 = EdgeSurface(
    CurveA=parameter_surface_isocurve,
    CurveB=parameter_surface_isocurve_7,
    CurveC=parameter_surface_isocurve_4,
    CurveD=parameter_surface_isocurve_5)
edge_surface_8 = EdgeSurface(
    CurveA=parameter_surface_isocurve_2,
    CurveB=parameter_surface_isocurve_6,
    CurveC=parameter_surface_isocurve_3,
    CurveD=parameter_surface_isocurve_8)
brep_join = BrepJoin(Breps=[edge_surface, edge_surface_2, edge_surface_3, edge_surface_4, edge_surface_5, edge_surface_6])  # -> Breps, Closed
panel = Panel(brep_join.Closed)
construct_domain² = ConstructDomain²(DomainU=construct_domain, DomainV=construct_domain_2)
split_brep = SplitBrep(Brep=brep_join.Breps, Cutter=edge_surface_8)
isotrim = Isotrim(Surface=reparameterize(edge_surface_3), Domain=construct_domain²)
isotrim_2 = Isotrim(Surface=reparameterize(edge_surface_4), Domain=construct_domain²)
list_item_2 = ListItem(List=split_brep, Index=0, Wrap=True)  # -> Item, Item1
brep_join_2 = BrepJoin(Breps=flatten([list_item_2.Item1, edge_surface_8]))  # -> Breps, Closed
brep_join_3 = BrepJoin(Breps=flatten([list_item_2.Item, edge_surface_8]))  # -> Breps, Closed
deconstruct_brep = DeconstructBrep(Brep=isotrim)  # -> Faces, Edges, Vertices
deconstruct_brep_2 = DeconstructBrep(Brep=isotrim_2)  # -> Faces, Edges, Vertices
split_brep_2 = SplitBrep(Brep=brep_join_3.Breps, Cutter=edge_surface_7)
list_item_3 = ListItem(List=deconstruct_brep_2.Vertices, Index=0, Wrap=True)  # -> Item, Item1, Item2, Item3
list_item_4 = ListItem(List=deconstruct_brep.Vertices, Index=0, Wrap=True)  # -> Item, Item1, Item2, Item3
list_item_5 = ListItem(List=deconstruct_brep_2.Edges, Index=0, Wrap=True)  # -> Item, Item1, Item2, Item3
list_item_6 = ListItem(List=deconstruct_brep.Edges, Index=0, Wrap=True)  # -> Item, Item1, Item2, Item3
list_item_7 = ListItem(List=split_brep_2, Index=0, Wrap=True)  # -> Item, Item1
geometry_15 = Geometry(list_item_6.Item2)
line = Line(StartPoint=list_item_4.Item, EndPoint=list_item_3.Item)
line_2 = Line(StartPoint=list_item_4.Item1, EndPoint=list_item_3.Item1)
line_3 = Line(StartPoint=list_item_4.Item2, EndPoint=list_item_3.Item2)
line_4 = Line(StartPoint=list_item_4.Item3, EndPoint=list_item_3.Item3)
brep_join_4 = BrepJoin(Breps=flatten([list_item_7.Item, edge_surface_7]))  # -> Breps, Closed
brep_join_5 = BrepJoin(Breps=flatten([list_item_7.Item1, edge_surface_7]))  # -> Breps, Closed
geometry_16 = Geometry(list_item_5.Item3)
number_slider = Slider(3, range=0..10)
number_slider_2 = Slider(2, range=0..10)
edge_surface_9 = EdgeSurface(CurveA=line, CurveB=list_item_6.Item, CurveC=list_item_5.Item, CurveD=line_2)
edge_surface_10 = EdgeSurface(CurveA=line_2, CurveB=list_item_6.Item1, CurveC=list_item_5.Item1, CurveD=line_3)
edge_surface_11 = EdgeSurface(CurveA=line_3, CurveB=list_item_6.Item2, CurveC=line_4, CurveD=list_item_5.Item2)
edge_surface_12 = EdgeSurface(CurveA=line, CurveB=list_item_6.Item3, CurveC=line_4, CurveD=list_item_5.Item3)
brep_join_6 = BrepJoin(Breps=flatten([edge_surface_9, edge_surface_10, edge_surface_11, edge_surface_12, isotrim, isotrim_2]))  # -> Breps, Closed
division = Division(A=number_slider_2, B="2")
division_2 = Division(A=Slider(2, range=0..10), B="2")
multiplication = Multiplication(A=number_slider, B=number_slider_2)
surface_frames = SurfaceFrames(Surface=edge_surface_3, UCount=number_slider, VCount=number_slider_2)  # -> flatten(Frames), Parameters
surface_frames_2 = SurfaceFrames(Surface=edge_surface_4, UCount=number_slider, VCount=number_slider_2)  # -> flatten(Frames), Parameters
addition = Addition(A=number_slider, B=division)
panel_2 = Panel(brep_join_6.Closed)
addition_2 = Addition(A=multiplication, B=division_2)
list_item_8 = ListItem(List=surface_frames.Frames, Index=addition, Wrap=True)
list_item_9 = ListItem(List=surface_frames.Frames, Index=addition_2, Wrap=True)
list_item_10 = ListItem(List=surface_frames_2.Frames, Index=addition, Wrap=True)
list_item_11 = ListItem(List=surface_frames_2.Frames, Index=addition_2, Wrap=True)
dimensions = Dimensions(Surface=edge_surface_8)  # -> UDimension, VDimension
panel_3 = Panel("0")
panel_4 = Panel("2")
line_5 = Line(StartPoint=list_item_8, EndPoint=list_item_10)
line_6 = Line(StartPoint=list_item_9, EndPoint=list_item_11)
minimum = Minimum(A=dimensions.UDimension, B=dimensions.VDimension)
number_slider_3 = Slider(0.2, range=0..1)
multiplication_2 = Multiplication(A=minimum, B=Slider(0.14, range=0.1..0.3))
multiplication_3 = Multiplication(A=Slider(0.7, range=0..1), B=multiplication_2)
extend_curve = ExtendCurve(Curve=reparameterize(line_5), Type=0, Start=number_slider_3, End=number_slider_3)
extend_curve_2 = ExtendCurve(Curve=reparameterize(line_6), Type=0, Start=number_slider_3, End=number_slider_3)
merge = Merge(Data1="0", Data2="1")
merge_2 = Merge(Data1=multiplication_3, Data2=multiplication_2)
line_7 = Line(extend_curve)
line_8 = Line(extend_curve_2)
pipe_variable = PipeVariable(Curve=line_7, Parameters=merge, Radii=merge_2, Caps=1)
pipe_variable_2 = PipeVariable(Curve=line_8, Parameters=merge, Radii=merge_2, Caps=1)
panel_5 = Panel(merge_2)
merge_3 = Merge(Data1=pipe_variable, Data2=pipe_variable_2)

geometry_17 = Geometry(brep_join_4.Breps)
geometry_18 = Geometry(brep_join_5.Breps)
geometry_19 = Geometry(brep_join_2.Breps)
solid_difference = SolidDifference(BrepsA=geometry_17, BrepsB=merge_3)
solid_difference_2 = SolidDifference(BrepsA=geometry_18, BrepsB=merge_3)
solid_difference_3 = SolidDifference(BrepsA=geometry_19, BrepsB=merge_3)

geometry_20 = Geometry([solid_difference, solid_difference_2, solid_difference_3, merge_3])
