# Grasshopper definition zac.ghx (Grasshopper 1.0.7)
# plug-ins: Pufferfish

curve = Curve([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])  # disabled
number_slider = Slider(12, range=0..100)  # disabled
number_slider_2 = Slider(7, range=0..100)  # disabled
number_slider_3 = Slider(75, range=0..100)  # disabled
bounding_box = BoundingBox(Content=curve, Plane=PlaneXY(0, 0, 0), UnionBox=True)  # -> Box, Box_2; disabled
strength = Slider(0.893, range=-1..1)  # disabled
radius = Slider(1218.146, range=0..2000)  # disabled
populate_3d = Populate3D(Region=bounding_box.Box, Count=number_slider, Seed=1)  # disabled
divide_curve = DivideCurve(Curve=curve, Count=number_slider_2, Kinks=False)  # -> Points, Tangents, Parameters; disabled
range = Range(Domain=Domain(0, 1), Steps=number_slider_3)  # disabled
number_slider_4 = Slider(3, range=0..10)  # disabled
graph_mapper = GraphMapper(
    range,
    x0=0,
    x1=1,
    y0=0,
    y1=1,
    container_name="Sine",
    Equation_px=[0.001739059691, 0.1536232829],
    Equation_py=[0.2263767123, 0.807246089])  # disabled
list_item = ListItem(List=reverse(divide_curve.Points), Index=0, Wrap=True)  # disabled
list_item_2 = ListItem(List=divide_curve.Points, Index=0, Wrap=True)  # disabled
relative_dir = Panel("xx")  # disabled
panel = Panel("C:\Users\Zac\Desktop")  # disabled
read_file = ReadFile(PerLineParse=False)  # disabled
number_slider_5 = Slider(3, range=0..100)  # disabled
number_slider_6 = Slider(30, range=0..100)  # disabled
number_slider_7 = Slider(4, range=0..100)  # disabled
number_slider_8 = Slider(14, range=0..100)  # disabled
number_slider_9 = Slider(4, range=0..100)  # disabled
number_slider_10 = Slider(30, range=0..100)  # disabled
number_slider_11 = Slider(30, range=0..100)  # disabled
number_slider_12 = Slider(4, range=0..100)  # disabled
number_slider_13 = Slider(0.329, range=0..1)  # disabled
number_slider_14 = Slider(10, range=0..10)  # disabled
number_slider_15 = Slider(0.675, range=0..1)  # disabled
number_slider_16 = Slider(0.342, range=0..1)  # disabled
boolean_toggle = BooleanToggle(False)  # disabled
boolean_toggle_2 = BooleanToggle(False)  # disabled
boolean_toggle_3 = BooleanToggle(False)  # disabled
boolean_toggle_4 = BooleanToggle(False)  # disabled
merge = Merge(Data1=list_item_2, Data2=list_item)  # disabled
base_surfaces = Surface([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])  # disabled
base_surface = Surface(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)  # disabled
number_slider_17 = Slider(0.02, range=0..0.1)  # disabled
number_slider_18 = Slider(50, range=0..100)  # disabled
linearize_numbers = LinearizeNumbers(Numbers=graph_mapper, Domain=Domain(0, 1))  # -> Linearized, Actual, Original; disabled
base_surface_2 = Surface(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)  # disabled
base_surface_3 = Surface(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)  # disabled
ghpython_script = GhPythonScript()  # -> Out, OutTemp; disabled
_0_to_1_00 = Slider(0, range=0..1)  # disabled
_1_to_100 = Slider(0, range=0..100)  # disabled
relative_path = GhPythonScript(RelativeDir=relative_dir)  # -> Dir; disabled
# ---------- relative_path: Python ----------
import os

path = ghenv.Component.OnPingDocument().FilePath
Dir = os.path.join(os.path.dirname(path),RelativeDir)

print Dir

ghenv.Component.Message = "Location:"+str(Dir)
# ---------- end relative_path ----------
surface = Surface([<surface referenced from the Rhino model> x3])  # disabled
deconstruct_brep = DeconstructBrep(Brep=surface)  # -> Faces, Edges, Vertices; disabled
pinch_n_spread_points = PinchNSpreadPoints(
    Points=divide_curve.Points,
    Locations=populate_3d,
    Radii=radius,
    Strengths=strength,
    Falloffs=number_slider_13,
    Exponents=number_slider_14,
    Weights1=number_slider_15,
    Weights2=number_slider_16,
    Anchors=merge)  # disabled
xz_plane = XZPlane(Origin=Point(0, 0, 0))  # disabled
net_on_surface = NetOnSurface(Surface=base_surface_3, CountU=number_slider_11, CountV=number_slider_12, Flip=boolean_toggle_3)  # disabled
net_on_surface_2 = NetOnSurface(Surface=base_surface_2, CountU=number_slider_10, CountV=number_slider_9, Flip=boolean_toggle_2)  # disabled
net_on_surface_3 = NetOnSurface(Surface=base_surface, CountU=number_slider_6, CountV=number_slider_7, Flip=boolean_toggle)  # disabled
net_on_surface_4 = NetOnSurface(Surface=base_surfaces, CountU=number_slider_8, CountV=number_slider_5, Flip=boolean_toggle_4)  # disabled
c_script = CSharpScript()  # -> Out, A; disabled
join_curves = JoinCurves(Curves=deconstruct_brep.Edges, Preserve=False)  # -> flatten(Curves); disabled
twisted_box_through_surfaces = TwistedBoxThroughSurfaces(
    Surfaces=surface,
    ParametersU=[0, 0.25, 0.5, 0.75, 1],
    ParametersV=[0, 0.25, 0.5, 0.75, 1],
    ParametersW=linearize_numbers.Linearized,
    Normalized=True,
    Equalized=False,
    Weighted=False,
    Loopback=False,
    Degree=3,
    InterpolationType=number_slider_4,
    Refit=0,
    PointSample=0)  # disabled
series = Series(Start=0, Step=number_slider_17, Count=number_slider_18)  # disabled
colour_swatch = ColourSwatch(SwatchColor=RGB(74, 227, 0))  # disabled
colour_swatch_2 = ColourSwatch(SwatchColor=RGB(255, 255, 195))  # disabled

colour_swatch_3 = ColourSwatch(SwatchColor=RGB(247, 255, 0))  # disabled
custom_preview = CustomPreview(Geometry=net_on_surface_2, Shader=colour_swatch_3)  # disabled

rotate = Rotate(Geometry=net_on_surface, Angle=1.570796327, Plane=xz_plane)  # -> Geometry, Transform; disabled
nurbs_curve = NurbsCurve(Vertices=pinch_n_spread_points, Degree=3, Periodic=False)  # -> Curve, Length, Domain; disabled
custom_preview_2 = CustomPreview(Geometry=net_on_surface_3, Shader=colour_swatch)  # disabled
custom_preview_3 = CustomPreview(Geometry=net_on_surface_4, Shader=colour_swatch_2)  # disabled
colour_swatch_4 = ColourSwatch(SwatchColor=RGB(0, 229, 255))  # disabled
custom_preview_4 = CustomPreview(Geometry=nurbs_curve.Curve, Shader=colour_swatch_4)  # disabled
colour_swatch_5 = ColourSwatch(SwatchColor=RGB(0, 72, 255))  # disabled
tween_through_curves = TweenThroughCurves(
    Curves=join_curves,
    Factor=series,
    Normalized=True,
    Equalized=False,
    Loopback=False,
    InterpolationType=0,
    Refit=0,
    PointSample=0)  # disabled

colour_swatch_6 = ColourSwatch(SwatchColor=RGB(0, 255, 238))  # disabled
custom_preview_5 = CustomPreview(Geometry=rotate.Geometry, Shader=colour_swatch_6)  # disabled

twisted_box = TwistedBox(twisted_box_through_surfaces)  # disabled
custom_preview_6 = CustomPreview(Geometry=twisted_box_through_surfaces, Shader=colour_swatch_5)  # disabled
number_slider_19 = Slider(15, range=0..100)  # disabled
explode = Explode(Curve=tween_through_curves, Recursive=True)  # -> Segments, Vertices; disabled
divide_curve_2 = DivideCurve(Curve=explode.Segments, Count=number_slider_19, Kinks=False)  # -> Points, Tangents, Parameters; disabled
series_2 = Series(Start=0, Step=Slider(0.65, range=0..1), Count=Slider(10, range=0..10))
never_change = BooleanToggle(True)
ziteration = Slider(6, range=0..30)
maxradius = Slider(64, range=0..200)
mimradius = Slider(12, range=0..50)
curve_2 = Curve(<curve referenced from the Rhino model>)
divide_curve_3 = DivideCurve(Curve=curve_2, Count=Slider(18, range=0..50), Kinks=never_change)  # -> Points, Tangents, Parameters
point = Point(Point(104.9546522, 395.3045783, 0))
curve_3 = Curve(<curve referenced from the Rhino model>)
c_script_2 = CSharpScript(
    Points=divide_curve_3.Points,
    Iteration=series_2,
    MaxRadius=maxradius,
    MinRadius=mimradius,
    T=Slider(177, range=0..1000),
    AttractPoint=point,
    Edge=curve_3,
    MaxCount=Slider(2, range=0..1000))  # -> out, OutPoints, Radiuses, OutTemp; inputs Points: list of Point3d, Iteration: Double, MaxRadius: Double, MinRadius: Double, T: Int32, AttractPoint: Point3d, Edge: Curve, MaxCount: Int32
# ---------- c_script_2: C# ----------
    // !Initialization
    List<Circle> circles = new List<Circle>();
    List<double> radiuses = new List<double>();


    for (int i = 0; i < Points.Count; i++)
    {
      radiuses.Add(Remap(Points[i].DistanceTo(AttractPoint), T, 0, MinRadius, MaxRadius));
    }

    //!Iteration
    for (int iteration = 0; iteration < Iteration; iteration++)
    {

      List<Vector3d> totalVector = new List<Vector3d>();
      List<double> counts = new List<double>();
      for (int i = 0; i < Points.Count; i++)
      {
        totalVector.Add(new Vector3d(0, 0, 0));
        counts.Add(0);
      }

      for (int i = 0; i < Points.Count; i++)
        for (int j = i + 1; j < Points.Count; j++)
        {
          double distance = Points[i].DistanceTo(Points[j]);
          if (radiuses[i] + radiuses[j] > distance)
          {

            Vector3d subVector = Points[i] - Points[j];
            subVector.Unitize();
            subVector *= 1 * (radiuses[i] + radiuses[j] - distance);
            // subVector *= 0.5 / distance;
            // subVector *= 
            totalVector[i] += subVector;
            totalVector[j] -= subVector;
            counts[i] += 1;
            counts[j] += 1;

          }


        }


      for (int k = 0; k < Points.Count; k++)
      {

        double t;
        if (k == 0 || k == Points.Count - 1) t = 0;
        else
        {
          Vector3d v0 = new Vector3d(Points[k - 1] - Points[k]);
          Vector3d v1 = new Vector3d(Points[k + 1] - Points[k]);

          t =Math.Abs(  Vector3d.VectorAngle(v0, v1));


          // if (t > Math.PI) t = t - Math.PI;

          // t = 1 - (t / Math.PI);
          t = (t / Math.PI);
        }

        if (iteration == Iteration-1 ) Print(t.ToString());
        if (counts[k] != 0)
        {

          if (Edge.Contains(Points[k], Plane.WorldXY, 0.01) == PointContainment.Inside)
          {
            Vector3d move = totalVector[k] / counts[k];
            Points[k] += move *t;
          }
        }

      }

      //! Add points
      if (Points.Count < MaxCount)
      {
        List<int> Indices = new List<int>();

        for (int i = 0; i < Points.Count - 1; i++)
        {
          if (Points[i].DistanceTo(Points[i + 1]) > radiuses[i] + radiuses[i + 1])
          { Indices.Add(i + 1 + Indices.Count); }
        }
        foreach (int Index in Indices)
        {
          if (Points.Count < MaxCount)
          {
            Point3d addPoint = 0.5 * (Points[Index - 1] + Points[Index]);
            Points.Insert(Index, addPoint);
          }
        }
      }


      // ! Generate the radius
      radiuses = new List<double>();
      for (int i = 0; i < Points.Count; i++)
      {
        radiuses.Add(Remap(Points[i].DistanceTo(AttractPoint), 20, 0, MinRadius, MaxRadius));
      }

      // Print(totalVector[54].Length.ToString());
    }


    //! Make curve




    //!Info
    // Print("Points.Count =" + Points.Count.ToString());
    // ! Output
    // zOutTemp = curves;
    OutPoints = Points;
    Radiuses = radiuses;
# ---------- c_script_2: C# additional code ----------
  bool IsLinear(Point3d p0, Point3d p1, Point3d p2)
  {

    Vector3d v1 = new Vector3d(p1 - p0);
    Vector3d v2 = new Vector3d(p2 - p1);


    double x = v1.X / v2.X;

    if (v1.Y / v2.Y == x && v1.Z / v2.Z == x) { return true; }
    else return false;
  }
  double Remap(double x, double t1, double t2, double s1, double s2)
  {
    double mapped = (s2 - s1) / (t2 - t1) * (x - t1) + s1;
    if (mapped < s1) mapped = s1;
    if (mapped > s2) mapped = s2;
    return mapped;
    // return (x - t1) / (t2 - t1) * (s2 - s1) + s1;
  }
# ---------- end c_script_2 ----------
subtraction = Subtraction(A=c_script_2.Radiuses, B=Slider(10, range=0..10))
circle = Circle(Plane=c_script_2.OutPoints, Radius=subtraction)
c_script_3 = CSharpScript(Points=c_script_2.OutPoints, Radius=subtraction)  # -> out, Dir, OutTemp; inputs Points: list of Point3d, Radius: list of Double
# ---------- c_script_3: C# usings ----------
using Rhino.Geometry.Intersect;
# ---------- c_script_3: C# ----------
    //! Params and declarations
    // double maxTangentArcRadius = 0;
    // double minTangentArcRadius = 0.3;

    Random random = new Random();
    List<NurbsCurve> curves = new List<NurbsCurve>();
    List<NurbsCurve> tangents = new List<NurbsCurve>();
    NurbsCurve curve = new NurbsCurve(0, 0);
    List<bool> dir = new List<bool>();



    //! Dir
    bool initial = false;//! true: clockwise, false: anti-clockwise
    dir.Add(initial);
    dir.Add(initial);
    for (int i = 2; i < Points.Count - 1; i++)
    {
      // if

      // if (PointSideOfLine(Points[i - 1], Points[i + 1], Points[i]) != PointSideOfLine(Points[i - 2], Points[i], Points[i - 1])) initial = !initial;

      initial = ! PointSideOfLine(Points[i - 1], Points[i + 1], Points[i]);


      if (Points[i].DistanceTo(Points[i - 1]) < Radius[i] + Radius[i - 1] && initial != dir[i - 1]) initial = !initial;
      dir.Add(initial);
      // bool flip = false;



      // if (Points[i].DistanceTo(Points[i + 1]) < Radius[i] + Radius[i + 1]) { flip = true; }
      // if (i > 1)
      // {
      // if (new Vector3d(Points[i ] - Points[i-1]) * new Vector3d(Points[i - 2] - Points[i - 1]) > 0) { flip = true; }
      // }
      // if (!flip) initial = !initial;
      // dir.Add(initial);


      // Print(flip.ToString());

    }
    dir.Add(initial);
  
    //! Curve
    for (int i = 0; i < Points.Count - 1; i++)
    {

      NurbsCurve l0 = new NurbsCurve(0, 0);
      NurbsCurve l1 = new NurbsCurve(0, 0);
      double radius = Points[i].DistanceTo(Points[i + 1])*2;

      // maxTangentArcRadius * (random.NextDouble() + minTangentArcRadius);

      if (dir[i] != dir[i + 1]) getTangentLineCurves(Points[i], Radius[i], Points[i + 1], Radius[i + 1], out l0, out l1);//* Tangent line

      else getTangentArcs(Points[i], Radius[i], Points[i + 1], Radius[i + 1], radius, out l0, out l1);//* Tangent Arc

      //!Add
      if (dir[i]) tangents.Add(l0);
      else tangents.Add(l1);

      //! Solve intersection
      // if (i > 0)
      // {
      //   if (IsLineLineIntersect(tangents[i - 1].PointAtStart, tangents[i - 1].PointAtEnd, tangents[i].PointAtStart, tangents[i].PointAtEnd))
      //   {
      //     getTangentArcs(Points[i - 1], Radius[i - 1], Points[i], Radius[i], radius, out l0, out l1);

      //     if (dir[i - 1]) tangents[i - 1] = l1;
      //     else tangents[i - 1] = l0;

      //     dir[i - 1] = !dir[i - 1];
      //     // flag = !flag;

      //     if (dir[i] != dir[i + 1]) getTangentLineCurves(Points[i], Radius[i], Points[i + 1], Radius[i + 1], out l0, out l1);//* Tangent line
      //     else getTangentArcs(Points[i], Radius[i], Points[i + 1], Radius[i + 1], radius, out l0, out l1);//* Tangent Arc
      //     if (dir[i]) tangents[i] = l1;
      //     else tangents[i] = l0;
      //     for (int k = i; i<dir.Count; k++){
      //       dir[k] = !dir[k];
      //     }

      //   }
      // }
    }


    //! Circle part

    for (int i = 0; i < tangents.Count - 1; i++)
    {
      curves.Add(tangents[i]);
      curves.Add(new Arc(tangents[i].PointAtEnd, tangents[i].TangentAtEnd, tangents[i + 1].PointAtStart).ToNurbsCurve());
      Print(tangents[i].PointAtEnd.ToString());
      Print(tangents[i].TangentAtEnd.ToString());
      Print(tangents[i + 1].PointAtStart.ToString());

    }
    curves.Add(tangents[tangents.Count - 1]);


    //! Output
    Dir = dir;
    // OutTemp = tangents;
    OutTemp = curves;
    //! End
# ---------- c_script_3: C# additional code ----------
  //! Start Tangent Arcs

  void getTangentArcs(Point3d p0, double r0, Point3d p1, double r1, double Radius, out NurbsCurve l0, out NurbsCurve l1)
  {

    double radius = (p0.DistanceTo(p1) - r0 - r1) / 2;
    if (radius < Radius)
    {

      Point3d intersectionPoint0 = new Point3d();
      Point3d intersectionPoint1 = new Point3d();

      CircleCircleIntersection(p0, r0 + Radius, p1, r1 + Radius, out intersectionPoint0, out intersectionPoint1);

      //! intersectionPoint0

      double t0 = r0 / p0.DistanceTo(intersectionPoint0);
      Point3d LCIntersection0 = p0 * (1 - t0) + intersectionPoint0 * t0;

      double t1 = r1 / p1.DistanceTo(intersectionPoint0);
      Point3d LCIntersection1 = p1 * (1 - t1) + intersectionPoint0 * t1;

      Vector3d centerToIntersectionPoint = new Vector3d(p0 - intersectionPoint0);

      Vector3d normal = new Vector3d(1, -centerToIntersectionPoint.X / centerToIntersectionPoint.Y, p0.Z);
      if (normal * new Vector3d(LCIntersection1 - LCIntersection0) < 0) { normal = -normal; }
      l0 = new Arc(LCIntersection0, normal, LCIntersection1).ToNurbsCurve();

      // l0 = new Line(intersectionPoint0, intersectionPoint1).ToNurbsCurve();


      //! IntersectionPoint1
      t0 = r0 / p0.DistanceTo(intersectionPoint1);
      LCIntersection0 = p0 * (1 - t0) + intersectionPoint1 * t0;

      t1 = r1 / p1.DistanceTo(intersectionPoint1);
      LCIntersection1 = p1 * (1 - t1) + intersectionPoint1 * t1;

      centerToIntersectionPoint = new Vector3d(p0 - intersectionPoint1);

      normal = new Vector3d(1, -centerToIntersectionPoint.X / centerToIntersectionPoint.Y, p0.Z);
      if (normal * new Vector3d(LCIntersection1 - LCIntersection0) < 0) { normal = -normal; }
      l1 = new Arc(LCIntersection0, normal, LCIntersection1).ToNurbsCurve();
      // l1 = null;


    }
    else
    {
      Vector3d v = new Vector3d(p1 - p0);
      v.Unitize();

      Point3d pt0 = p0 + v * r0;
      Point3d pt1 = p1 - v * r1;
      Vector3d normal = new Vector3d(1, -v.X / v.Y, v.Z);

      l0 = new Arc(pt0, normal, pt1).ToNurbsCurve();
      l1 = new Arc(pt0, -normal, pt1).ToNurbsCurve();

    }


  }

  void CircleCircleIntersection(Point3d p0, double r0, Point3d p1, double r1, out Point3d intersection0, out Point3d intersection1)
  {

    double d = p0.DistanceTo(p1);//AB
    // if (d == r0 + r1)
    // {
    //   Print("wow".ToString());
    //   Print(r0.ToString());
    //   Print(r1.ToString());
    //   Print(d.ToString());
    // }

    // Print((d == r0 + r1).ToString());

    double cosA = (r1 * r1 + d * d - r0 * r0) / (2 * r1 * d);
    double d1 = r1 * cosA;
    double t1 = d1 / d;
    Point3d midPt = p0 * t1 + p1 * (1 - t1);


    double h = Math.Sqrt(Math.Pow(r1, 2) - Math.Pow(d1, 2)); //CE
    // Print(h.ToString());
    Vector3d normal = new Vector3d(p0 - p1);
    normal.Transform(Transform.Rotation(Math.PI * 0.5, Vector3d.ZAxis, p0));
    normal.Unitize();
    normal *= h;

    intersection0 = midPt - normal; //!Clockwise one
    intersection1 = midPt + normal;//!Anti-clockwise one

    // intersection0 = midPt ;
    // intersection1 = midPt +Vector3d.YAxis;


  }


  //! Start Tangent Lines
  void getTangentLineCurves(Point3d p0, double r0, Point3d p1, double r1, out NurbsCurve l0, out NurbsCurve l1)
  {
    Point3d r1_low_point = new Point3d();
    Point3d r0_up_point = new Point3d();
    Point3d r0_low_point = new Point3d();
    Point3d r1_up_point = new Point3d();

    double aa = Math.Atan2((p1.Y - p0.Y), (p1.X - p0.X));  //求中两个圆心连线的斜率角度
    double centerLine;

    centerLine = p0.DistanceTo(p1); //求两个圆心连线长度

    double bb = Math.Acos((r0 + r1) / centerLine);  //求两个圆心连线和圆心到切点垂线的夹角
    double cc = bb - aa;
    double r2LowX = r1 * Math.Cos(cc);
    double r2LowY = r1 * Math.Sin(cc);
    double r1UpX = r0 * Math.Cos(cc);
    double r1UpY = r0 * Math.Sin(cc);
    r1_low_point.X = p1.X - r2LowX;
    r1_low_point.Y = p1.Y + r2LowY;
    r0_up_point.X = p0.X + r1UpX;
    r0_up_point.Y = p0.Y - r1UpY;
    Point3d r2_tempoint = Transition(r1_low_point.X - p1.X, r1_low_point.Y - p1.Y, 2 * bb, 1);
    r1_up_point.X = p1.X + r2_tempoint.X;
    r1_up_point.Y = p1.Y + r2_tempoint.Y;
    Point3d r1_tempoint = Transition(r0_up_point.X - p0.X, r0_up_point.Y - p0.Y, 2 * bb, 1);
    r0_low_point.X = p0.X + r1_tempoint.X;
    r0_low_point.Y = p0.Y + r1_tempoint.Y;


    l0 = new Line(r0_low_point, r1_up_point).ToNurbsCurve(); //!Clockwise one
    l1 = new Line(r0_up_point, r1_low_point).ToNurbsCurve();//!Anti-clockwise one


  }
  //点绕点旋转
  Point3d Transition(double _x, double _y, double _angle, int fx)
  {
    double newX = 0;
    double newY = 0;
    if (fx == 1)
    {
      newX = _x * Math.Cos(_angle) - _y * Math.Sin(_angle);
      newY = _x * Math.Sin(_angle) + _y * Math.Cos(_angle);
    }
    else
    {
      newX = _x * Math.Cos(_angle) + _y * Math.Sin(_angle);
      newY = _y * Math.Cos(_angle) - _x * Math.Sin(_angle);
    }
    return new Point3d(newX, newY, 0);
  }

  //! Line Line intersection by ChatGPT
  // Check if two lines intersect
  // The lines are defined by the points (x1, y1), (x2, y2)
  // and (x3, y3), (x4, y4) respectively
  // Returns true if the lines intersect, and false otherwise
  public static bool IsLineLineIntersect(Point3d p0, Point3d p1, Point3d p2, Point3d p3)
  {
    double x1 = p0.X;
    double y1 = p0.Y;
    double x2 = p1.X;
    double y2 = p1.Y;
    double x3 = p2.X;
    double y3 = p2.Y;
    double x4 = p3.X;
    double y4 = p3.Y;

    // Calculate the coefficients of the equations of the lines
    double a1 = y2 - y1;
    double b1 = x1 - x2;
    double c1 = a1 * x1 + b1 * y1;

    double a2 = y4 - y3;
    double b2 = x3 - x4;
    double c2 = a2 * x3 + b2 * y3;

    // Calculate the point of intersection
    double det = a1 * b2 - a2 * b1;
    if (det == 0)
    {
      // The lines are parallel
      return false;
    }
    else
    {
      double x = (b2 * c1 - b1 * c2) / det;
      double y = (a1 * c2 - a2 * c1) / det;

      // Check if the point of intersection is on both lines
      if ((x1 <= x && x <= x2 || x2 <= x && x <= x1) &&
          (x3 <= x && x <= x4 || x4 <= x && x <= x3) &&
          (y1 <= y && y <= y2 || y2 <= y && y <= y1) &&
          (y3 <= y && y <= y4 || y4 <= y && y <= y3))
      {
        // The lines intersect
        return true;
      }
      else
      {
        // The lines do not intersect
        return false;
      }
    }
  }


  //! Line side by ChatGPT
  public bool PointSideOfLine(Point3d p1, Point3d p2, Point3d p)
  {
    // Calculate the cross product of the two vectors determined by the three points.
    double crossProduct = (p2.X - p1.X) * (p.Y - p1.Y) - (p.X - p1.X) * (p2.Y - p1.Y);

    // If the cross product is positive, the point is on the left side of the line.
    if (crossProduct > 0)
    {
      return false; //left
    }
    // If the cross product is negative, the point is on the right side of the line.
    else
    {
      return true; //"right";
    }
  }
# ---------- end c_script_3 ----------
join_curves_2 = JoinCurves(Curves=c_script_3.OutTemp, Preserve=False)  # -> reparameterize(simplify(Curves))
point_on_curve = PointOnCurve(join_curves_2, parameter=1)
point_on_curve_2 = PointOnCurve(join_curves_2, parameter=0)
xz_plane_2 = XZPlane(Origin=point_on_curve_2)
yz_plane = YZPlane(Origin=point_on_curve)
mirror = Mirror(Geometry=join_curves_2, Plane=xz_plane_2)  # -> Geometry, Transform
mirror_2 = Mirror(Geometry=mirror.Geometry, Plane=yz_plane)  # -> Geometry, Transform
mirror_3 = Mirror(Geometry=join_curves_2, Plane=yz_plane)  # -> Geometry, Transform
merge_2 = Merge(Data1=join_curves_2, Data2=mirror.Geometry, Data3=mirror_2.Geometry, Data4=mirror_3.Geometry)
xy_plane = XYPlane(Origin=Point(0, 0, 0))
cluster = Cluster(curve=merge_2)
region_union = RegionUnion(Curves=cluster, Plane=xy_plane)
area = Area(Geometry=region_union)  # -> Area, Centroid
sort_list = SortList(Keys=area.Area, ValuesValuesA=region_union)  # -> Keys, reverse(ValuesValuesA)
series_3 = Series(Start=0, Step=Slider(50, range=0..100), Count=Slider(10, range=0..10))
list_item_3 = ListItem(List=sort_list.ValuesValuesA, Index=0, Wrap=True)
unit_z = UnitZ(Factor=series_3)
move = Move(Geometry=flatten(sort_list.ValuesValuesA), Motion=unit_z)  # -> Geometry, Transform
loft = Loft(Curves=move.Geometry, Options={Adjust=False, Closed=False, LoftEnds=0, LoftSimp=0, LoftType=0, Rebuild=10, Refit=0.01})

# ==== cluster Cluster
curve = ClusterInput()
curve_2 = Curve(curve)
point_on_curve = PointOnCurve(curve_2, parameter=1)
point_on_curve_2 = PointOnCurve(curve_2, parameter=0)
deconstruct = Deconstruct(Point=point_on_curve_2)  # -> XComponent, YComponent, ZComponent
deconstruct_2 = Deconstruct(Point=point_on_curve)  # -> XComponent, YComponent, ZComponent
construct_point = ConstructPoint(XCoordinate=deconstruct_2.XComponent, YCoordinate=deconstruct.YComponent, ZCoordinate=0)
line = Line(StartPoint=point_on_curve, EndPoint=construct_point)
line_2 = Line(StartPoint=point_on_curve_2, EndPoint=construct_point)
join_curves = JoinCurves(Curves=[line_2, curve_2, line], Preserve=False)
curves = ClusterOutput(join_curves)
