# Grasshopper definition zac_2.ghx (Grasshopper 1.0.7)

relative_dir = Panel("xx")
panel = Panel("C:\Users\Zac\Desktop")
read_file = ReadFile(PerLineParse=False)
ghpython_script = GhPythonScript()  # -> Out, OutTemp
_0_to_1_00 = Slider(0, range=0..1)
_1_to_100 = Slider(0, range=0..100)
relative_path = GhPythonScript(RelativeDir=relative_dir)  # -> Dir
# ---------- relative_path: Python ----------
import os

path = ghenv.Component.OnPingDocument().FilePath
Dir = os.path.join(os.path.dirname(path),RelativeDir)

print Dir

ghenv.Component.Message = "Location:"+str(Dir)
# ---------- end relative_path ----------
c_script = CSharpScript()  # -> Out, A
geometry = Geometry(<brep referenced from the Rhino model>)
curve = Curve([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])

curve_2 = Curve([<curve referenced from the Rhino model> x5])
area = Area(Geometry=curve_2)  # -> Area, Centroid
deconstruct = Deconstruct(Point=area.Centroid)  # -> XComponent, YComponent, ZComponent
construct_point = ConstructPoint(XCoordinate=0, YCoordinate=0, ZCoordinate=deconstruct.ZComponent)
vector_2pt = Vector2Pt(PointA=area.Centroid, PointB=construct_point, Unitize=False)  # -> Vector, Length
move = Move(Geometry=curve_2, Motion=vector_2pt.Vector)  # -> Geometry, Transform
sort_list = SortList(Keys=deconstruct.ZComponent, ValuesValuesA=move.Geometry)  # -> Keys, ValuesValuesA
list_item = ListItem(List=sort_list.ValuesValuesA, Index=0, Wrap=True)
flip_curve = FlipCurve(Curve=sort_list.ValuesValuesA, Guide=list_item)  # -> Curve, Flag

curve_3 = Curve([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])
contour = Contour(Shape=geometry, Point=Point(0, 0, 0), Direction=Vector(0, 0, 1), Distance=Slider(243, range=0..1000))
number_slider = Slider(15, range=0..100)  # disabled
number_slider_2 = Slider(0.1, range=0..1)  # disabled
layer_number = Slider(50, range=0..100)  # disabled
division = Division(A=number_slider, B=layer_number)  # disabled
layer_hight = Slider(6, range=0..10)  # disabled
series = Series(Start=number_slider, Step=division, Count=layer_number)  # -> reverse(Series); disabled
number_slider_3 = Slider(15, range=0..50)  # disabled
never_change = BooleanToggle(True)  # disabled
curve_4 = Curve(<curve referenced from the Rhino model>)  # disabled
ziteration = Slider(10, range=0..30)  # disabled
number_slider_4 = Slider(177, range=0..1000)  # disabled
maxradius = Slider(30, range=0..200)  # disabled
mimradius = Slider(16, range=0..50)  # disabled
number_slider_5 = Slider(2, range=0..1000)  # disabled
series_2 = Series(Start=1, Step=expr("-1/x", layer_number), Count=layer_number)  # disabled
division_2 = Division(A=ziteration, B=layer_number)  # disabled
yz_plane = YZPlane(Origin=Point(0, 0, 0))
series_3 = Series(Start=1, Step=division_2, Count=layer_number)  # disabled
scale = Scale(Geometry=curve_4, Center=Point(0, 0, 0), Factor=series_2)  # -> reverse(Geometry), Transform; disabled
divide_curve = DivideCurve(Curve=scale.Geometry, Count=series, Kinks=never_change)  # -> Points, Tangents, Parameters; disabled
curve_5 = Curve(reparameterize(flip_curve.Curve))
integer = Integer(graft(series_3))  # disabled
curve_plane = CurvePlane(Curve=curve_5, Plane=yz_plane)  # -> Points, ParamsC, ParamsP
list_item_2 = ListItem(List=curve_plane.ParamsC, Index=0, Wrap=True)  # -> flatten(Item), flatten(Item1)
panel_2 = Panel(divide_curve.Points)  # disabled
geometry_2 = Geometry(<point referenced from the Rhino model>)  # disabled
curve_6 = Curve(<curve referenced from the Rhino model>)  # disabled
number_slider_6 = Slider(1, range=0..1)
evaluate_curve = EvaluateCurve(Curve=curve_5, Parameter=list_item_2.Item)  # -> Point, Tangent, Angle
number_slider_7 = Slider(10, range=0..10)  # disabled
evaluate_curve_2 = EvaluateCurve(Curve=curve_5, Parameter=list_item_2.Item1)  # -> Point, Tangent, Angle
deconstruct_2 = Deconstruct(Point=evaluate_curve.Point)  # -> XComponent, YComponent, ZComponent
deconstruct_3 = Deconstruct(Point=evaluate_curve_2.Point)  # -> XComponent, YComponent, ZComponent
larger_than = LargerThan(FirstNumber=deconstruct_2.YComponent, SecondNumber=deconstruct_3.YComponent)  # -> LargerThan, OrEqualTo
pick_n_choose = PickNChoose(Pattern=larger_than.LargerThan, Stream0=list_item_2.Item, Stream1=list_item_2.Item1)
c_script_2 = CSharpScript(
    Points=divide_curve.Points,
    Iteration=integer,
    MaxRadius=maxradius,
    MinRadius=mimradius,
    T=number_slider_4,
    AttractPoint=geometry_2,
    Edge=curve_6,
    MaxCount=number_slider_5)  # -> out, OutPoints, Radiuses, OutTemp; inputs Points: list of Point3d, Iteration: Double, MaxRadius: Double, MinRadius: Double, T: Int32, AttractPoint: Point3d, Edge: Curve, MaxCount: Int32; disabled
# ---------- c_script_2: C# ----------
    // !Initialization
    List<Circle> circles = new List<Circle>();
    List<double> radiuses = new List<double>();


    for (int i = 0; i < Points.Count; i++)
    {
      radiuses.Add(Remap(Points[i].DistanceTo(AttractPoint), T, 0, MinRadius, MaxRadius));
    }

    //!Iteration
    for (int iteration = 0; iteration < Iteration; iteration++)
    {

      List<Vector3d> totalVector = new List<Vector3d>();
      List<double> counts = new List<double>();
      for (int i = 0; i < Points.Count; i++)
      {
        totalVector.Add(new Vector3d(0, 0, 0));
        counts.Add(0);
      }

      for (int i = 0; i < Points.Count; i++)
        for (int j = i + 1; j < Points.Count; j++)
        {
          double distance = Points[i].DistanceTo(Points[j]);
          if (radiuses[i] + radiuses[j] > distance)
          {

            Vector3d subVector = Points[i] - Points[j];
            subVector.Unitize();
            subVector *= 1 * (radiuses[i] + radiuses[j] - distance);
            // subVector *= 0.5 / distance;
            // subVector *= 
            totalVector[i] += subVector;
            totalVector[j] -= subVector;
            counts[i] += 1;
            counts[j] += 1;

          }


        }


      for (int k = 0; k < Points.Count; k++)
      {

        double t;
        if (k == 0 || k == Points.Count - 1) t = 0;
        else
        {
          Vector3d v0 = new Vector3d(Points[k - 1] - Points[k]);
          Vector3d v1 = new Vector3d(Points[k + 1] - Points[k]);

          t =Math.Abs(  Vector3d.VectorAngle(v0, v1));


          // if (t > Math.PI) t = t - Math.PI;

          // t = 1 - (t / Math.PI);
          t = (t / Math.PI);
        }

        if (iteration == Iteration-1 ) Print(t.ToString());
        if (counts[k] != 0)
        {

          if (Edge.Contains(Points[k], Plane.WorldXY, 0.01) == PointContainment.Inside)
          {
            Vector3d move = totalVector[k] / counts[k];
            Points[k] += move *t;
          }
        }

      }

      //! Add points
      if (Points.Count < MaxCount)
      {
        List<int> Indices = new List<int>();

        for (int i = 0; i < Points.Count - 1; i++)
        {
          if (Points[i].DistanceTo(Points[i + 1]) > radiuses[i] + radiuses[i + 1])
          { Indices.Add(i + 1 + Indices.Count); }
        }
        foreach (int Index in Indices)
        {
          if (Points.Count < MaxCount)
          {
            Point3d addPoint = 0.5 * (Points[Index - 1] + Points[Index]);
            Points.Insert(Index, addPoint);
          }
        }
      }


      // ! Generate the radius
      radiuses = new List<double>();
      for (int i = 0; i < Points.Count; i++)
      {
        radiuses.Add(Remap(Points[i].DistanceTo(AttractPoint), 20, 0, MinRadius, MaxRadius));
      }

      // Print(totalVector[54].Length.ToString());
    }


    //! Make curve




    //!Info
    // Print("Points.Count =" + Points.Count.ToString());
    // ! Output
    // zOutTemp = curves;
    OutPoints = Points;
    Radiuses = radiuses;
# ---------- c_script_2: C# additional code ----------
  bool IsLinear(Point3d p0, Point3d p1, Point3d p2)
  {

    Vector3d v1 = new Vector3d(p1 - p0);
    Vector3d v2 = new Vector3d(p2 - p1);


    double x = v1.X / v2.X;

    if (v1.Y / v2.Y == x && v1.Z / v2.Z == x) { return true; }
    else return false;
  }
  double Remap(double x, double t1, double t2, double s1, double s2)
  {
    double mapped = (s2 - s1) / (t2 - t1) * (x - t1) + s1;
    if (mapped < s1) mapped = s1;
    if (mapped > s2) mapped = s2;
    return mapped;
    // return (x - t1) / (t2 - t1) * (s2 - s1) + s1;
  }
# ---------- end c_script_2 ----------
seam = Seam(Curve=curve_5, Seam=pick_n_choose)
point_on_curve = PointOnCurve(seam, parameter=0)
subtraction = Subtraction(A=c_script_2.Radiuses, B=number_slider_7)  # disabled
circle = Circle(Plane=c_script_2.OutPoints, Radius=subtraction)  # -> simplify(Circle); disabled
curve_display = CurveDisplay(Curve=seam, Width=Slider(2, range=0..10), Colour=ColourSwatch(SwatchColor=RGB(0, 0, 0)))  # inputs Curve: Curve, Width: Int32, Colour: Color, Dash: String
# ---------- curve_display: C# ----------
    if (Curve == null) return;
    if (Width <= 0) return;

    double[] pattern = ParseDashPattern(Dash);
    IEnumerable<Curve> segments = ApplyDashPattern(Curve, pattern);

    _clip = BoundingBox.Union(_clip, Curve.GetBoundingBox(false));
    foreach (Curve segment in segments)
    {
      _curves.Add(segment);
      _colors.Add(Colour);
      _widths.Add(Width);
    }
# ---------- curve_display: C# additional code ----------
  /// <summary>
  /// Parse a dash pattern.
  /// </summary>
  /// <param name="pattern">Pattern to parse.</param>
  /// <returns>Array of dashes and gaps.</returns>
  private double[] ParseDashPattern(string pattern)
  {
    if (string.IsNullOrWhiteSpace(pattern))
      return null;

    string[] fragments = pattern.Split(new char[] {' '});
    if (fragments == null || fragments.Length == 0)
      return null;

    double[] values = new double[fragments.Length];
    for (int i = 0; i < fragments.Length; i++)
    {
      double v;
      if (!double.TryParse(fragments[i], out v))
        throw new Exception(fragments[i] + " is a not a valid number.");

      if (v <= 0.0)
        throw new Exception("Dashes or gaps must have a strictly positive length.");

      values[i] = v;
    }

    return values;
  }
  /// <summary>
  /// Apply a dash+gap pattern to a curve.
  /// </summary>
  private IEnumerable<Curve> ApplyDashPattern(Curve curve, double[] pattern)
  {
    if (pattern == null || pattern.Length == 0)
      return new Curve[] { curve };

    double curveLength = curve.GetLength();
    List<Curve> dashes = new List<Curve>();

    double offset0 = 0.0;
    int index = 0;
    while(true)
    {
      // Get the current dash length.
      double dashLength = pattern[index++];
      if (index >= pattern.Length)
        index = 0;

      // Compute the offset of the current dash from the curve start.
      double offset1 = offset0 + dashLength;
      if (offset1 > curveLength)
        offset1 = curveLength;

      // Solve the curve parameters at the current dash start and end.
      double t0, t1;
      curve.LengthParameter(offset0, out t0);
      curve.LengthParameter(offset1, out t1);

      Curve dash = curve.Trim(t0, t1);
      if (dash != null)
        dashes.Add(dash);

      // Get the current gap length.
      double gapLength = pattern[index++];
      if (index >= pattern.Length)
        index = 0;

      // Set the start of the next dash to be the end of the current
      // dash + the length of the adjacent gap.
      offset0 = offset1 + gapLength;

      // Abort when we've reached the end of the curve.
      if (offset0 >= curveLength)
        break;
    }

    return dashes;
  }

  private BoundingBox _clip;
  private readonly List<Curve> _curves = new List<Curve>();
  private readonly List<Color> _colors = new List<Color>();
  private readonly List<int> _widths = new List<int>();

  /// <summary>
  /// This method will be called once every solution, before any calls to RunScript.
  /// </summary>
  public override void BeforeRunScript()
  {
    _clip = BoundingBox.Empty;
    _curves.Clear();
    _colors.Clear();
    _widths.Clear();
  }

  /// <summary>
  /// Return a BoundingBox that contains all the geometry you are about to draw.
  /// </summary>
  public override BoundingBox ClippingBox
  {
    get { return _clip; }
  }
  /// <summary>
  /// Draw all wires and points in this method.
  /// </summary>
  public override void DrawViewportWires(IGH_PreviewArgs args)
  {
    for (int i = 0; i < _curves.Count; i++)
      args.Display.DrawCurve(_curves[i], _colors[i], _widths[i]);
  }
# ---------- end curve_display ----------
number_slider_8 = Slider(1, range=0..1)  # disabled
loft_options = LoftOptions(Closed=False, Adjust=False, Rebuild=Slider(50, range=0..100), Refit=Slider(0.01, range=0..0.01), Type=3)
c_script_3 = CSharpScript(Points=c_script_2.OutPoints, Radius=subtraction)  # -> out, Dir, OutTemp; inputs Points: list of Point3d, Radius: list of Double; disabled
# ---------- c_script_3: C# usings ----------
using Rhino.Geometry.Intersect;
# ---------- c_script_3: C# ----------
    //! Params and declarations
    // double maxTangentArcRadius = 0;
    // double minTangentArcRadius = 0.3;

    Random random = new Random();
    List<NurbsCurve> curves = new List<NurbsCurve>();
    List<NurbsCurve> tangents = new List<NurbsCurve>();
    NurbsCurve curve = new NurbsCurve(0, 0);
    List<bool> dir = new List<bool>();



    //! Dir
    bool initial = false;//! true: clockwise, false: anti-clockwise
    dir.Add(initial);
    dir.Add(initial);
    for (int i = 2; i < Points.Count - 1; i++)
    {
      // if

      // if (PointSideOfLine(Points[i - 1], Points[i + 1], Points[i]) != PointSideOfLine(Points[i - 2], Points[i], Points[i - 1])) initial = !initial;

      initial = ! PointSideOfLine(Points[i - 1], Points[i + 1], Points[i]);


      if (Points[i].DistanceTo(Points[i - 1]) < Radius[i] + Radius[i - 1] && initial != dir[i - 1]) initial = !initial;
      dir.Add(initial);
      // bool flip = false;



      // if (Points[i].DistanceTo(Points[i + 1]) < Radius[i] + Radius[i + 1]) { flip = true; }
      // if (i > 1)
      // {
      // if (new Vector3d(Points[i ] - Points[i-1]) * new Vector3d(Points[i - 2] - Points[i - 1]) > 0) { flip = true; }
      // }
      // if (!flip) initial = !initial;
      // dir.Add(initial);


      // Print(flip.ToString());

    }
    dir.Add(initial);
  
    //! Curve
    for (int i = 0; i < Points.Count - 1; i++)
    {

      NurbsCurve l0 = new NurbsCurve(0, 0);
      NurbsCurve l1 = new NurbsCurve(0, 0);
      double radius = Points[i].DistanceTo(Points[i + 1])*2;

      // maxTangentArcRadius * (random.NextDouble() + minTangentArcRadius);

      if (dir[i] != dir[i + 1]) getTangentLineCurves(Points[i], Radius[i], Points[i + 1], Radius[i + 1], out l0, out l1);//* Tangent line

      else getTangentArcs(Points[i], Radius[i], Points[i + 1], Radius[i + 1], radius, out l0, out l1);//* Tangent Arc

      //!Add
      if (dir[i]) tangents.Add(l0);
      else tangents.Add(l1);

      //! Solve intersection
      // if (i > 0)
      // {
      //   if (IsLineLineIntersect(tangents[i - 1].PointAtStart, tangents[i - 1].PointAtEnd, tangents[i].PointAtStart, tangents[i].PointAtEnd))
      //   {
      //     getTangentArcs(Points[i - 1], Radius[i - 1], Points[i], Radius[i], radius, out l0, out l1);

      //     if (dir[i - 1]) tangents[i - 1] = l1;
      //     else tangents[i - 1] = l0;

      //     dir[i - 1] = !dir[i - 1];
      //     // flag = !flag;

      //     if (dir[i] != dir[i + 1]) getTangentLineCurves(Points[i], Radius[i], Points[i + 1], Radius[i + 1], out l0, out l1);//* Tangent line
      //     else getTangentArcs(Points[i], Radius[i], Points[i + 1], Radius[i + 1], radius, out l0, out l1);//* Tangent Arc
      //     if (dir[i]) tangents[i] = l1;
      //     else tangents[i] = l0;
      //     for (int k = i; i<dir.Count; k++){
      //       dir[k] = !dir[k];
      //     }

      //   }
      // }
    }


    //! Circle part

    for (int i = 0; i < tangents.Count - 1; i++)
    {
      curves.Add(tangents[i]);
      curves.Add(new Arc(tangents[i].PointAtEnd, tangents[i].TangentAtEnd, tangents[i + 1].PointAtStart).ToNurbsCurve());
      Print(tangents[i].PointAtEnd.ToString());
      Print(tangents[i].TangentAtEnd.ToString());
      Print(tangents[i + 1].PointAtStart.ToString());

    }
    curves.Add(tangents[tangents.Count - 1]);


    //! Output
    Dir = dir;
    // OutTemp = tangents;
    OutTemp = curves;
    //! End
# ---------- c_script_3: C# additional code ----------
  //! Start Tangent Arcs

  void getTangentArcs(Point3d p0, double r0, Point3d p1, double r1, double Radius, out NurbsCurve l0, out NurbsCurve l1)
  {

    double radius = (p0.DistanceTo(p1) - r0 - r1) / 2;
    if (radius < Radius)
    {

      Point3d intersectionPoint0 = new Point3d();
      Point3d intersectionPoint1 = new Point3d();

      CircleCircleIntersection(p0, r0 + Radius, p1, r1 + Radius, out intersectionPoint0, out intersectionPoint1);

      //! intersectionPoint0

      double t0 = r0 / p0.DistanceTo(intersectionPoint0);
      Point3d LCIntersection0 = p0 * (1 - t0) + intersectionPoint0 * t0;

      double t1 = r1 / p1.DistanceTo(intersectionPoint0);
      Point3d LCIntersection1 = p1 * (1 - t1) + intersectionPoint0 * t1;

      Vector3d centerToIntersectionPoint = new Vector3d(p0 - intersectionPoint0);

      Vector3d normal = new Vector3d(1, -centerToIntersectionPoint.X / centerToIntersectionPoint.Y, p0.Z);
      if (normal * new Vector3d(LCIntersection1 - LCIntersection0) < 0) { normal = -normal; }
      l0 = new Arc(LCIntersection0, normal, LCIntersection1).ToNurbsCurve();

      // l0 = new Line(intersectionPoint0, intersectionPoint1).ToNurbsCurve();


      //! IntersectionPoint1
      t0 = r0 / p0.DistanceTo(intersectionPoint1);
      LCIntersection0 = p0 * (1 - t0) + intersectionPoint1 * t0;

      t1 = r1 / p1.DistanceTo(intersectionPoint1);
      LCIntersection1 = p1 * (1 - t1) + intersectionPoint1 * t1;

      centerToIntersectionPoint = new Vector3d(p0 - intersectionPoint1);

      normal = new Vector3d(1, -centerToIntersectionPoint.X / centerToIntersectionPoint.Y, p0.Z);
      if (normal * new Vector3d(LCIntersection1 - LCIntersection0) < 0) { normal = -normal; }
      l1 = new Arc(LCIntersection0, normal, LCIntersection1).ToNurbsCurve();
      // l1 = null;


    }
    else
    {
      Vector3d v = new Vector3d(p1 - p0);
      v.Unitize();

      Point3d pt0 = p0 + v * r0;
      Point3d pt1 = p1 - v * r1;
      Vector3d normal = new Vector3d(1, -v.X / v.Y, v.Z);

      l0 = new Arc(pt0, normal, pt1).ToNurbsCurve();
      l1 = new Arc(pt0, -normal, pt1).ToNurbsCurve();

    }


  }

  void CircleCircleIntersection(Point3d p0, double r0, Point3d p1, double r1, out Point3d intersection0, out Point3d intersection1)
  {

    double d = p0.DistanceTo(p1);//AB
    // if (d == r0 + r1)
    // {
    //   Print("wow".ToString());
    //   Print(r0.ToString());
    //   Print(r1.ToString());
    //   Print(d.ToString());
    // }

    // Print((d == r0 + r1).ToString());

    double cosA = (r1 * r1 + d * d - r0 * r0) / (2 * r1 * d);
    double d1 = r1 * cosA;
    double t1 = d1 / d;
    Point3d midPt = p0 * t1 + p1 * (1 - t1);


    double h = Math.Sqrt(Math.Pow(r1, 2) - Math.Pow(d1, 2)); //CE
    // Print(h.ToString());
    Vector3d normal = new Vector3d(p0 - p1);
    normal.Transform(Transform.Rotation(Math.PI * 0.5, Vector3d.ZAxis, p0));
    normal.Unitize();
    normal *= h;

    intersection0 = midPt - normal; //!Clockwise one
    intersection1 = midPt + normal;//!Anti-clockwise one

    // intersection0 = midPt ;
    // intersection1 = midPt +Vector3d.YAxis;


  }


  //! Start Tangent Lines
  void getTangentLineCurves(Point3d p0, double r0, Point3d p1, double r1, out NurbsCurve l0, out NurbsCurve l1)
  {
    Point3d r1_low_point = new Point3d();
    Point3d r0_up_point = new Point3d();
    Point3d r0_low_point = new Point3d();
    Point3d r1_up_point = new Point3d();

    double aa = Math.Atan2((p1.Y - p0.Y), (p1.X - p0.X));  //求中两个圆心连线的斜率角度
    double centerLine;

    centerLine = p0.DistanceTo(p1); //求两个圆心连线长度

    double bb = Math.Acos((r0 + r1) / centerLine);  //求两个圆心连线和圆心到切点垂线的夹角
    double cc = bb - aa;
    double r2LowX = r1 * Math.Cos(cc);
    double r2LowY = r1 * Math.Sin(cc);
    double r1UpX = r0 * Math.Cos(cc);
    double r1UpY = r0 * Math.Sin(cc);
    r1_low_point.X = p1.X - r2LowX;
    r1_low_point.Y = p1.Y + r2LowY;
    r0_up_point.X = p0.X + r1UpX;
    r0_up_point.Y = p0.Y - r1UpY;
    Point3d r2_tempoint = Transition(r1_low_point.X - p1.X, r1_low_point.Y - p1.Y, 2 * bb, 1);
    r1_up_point.X = p1.X + r2_tempoint.X;
    r1_up_point.Y = p1.Y + r2_tempoint.Y;
    Point3d r1_tempoint = Transition(r0_up_point.X - p0.X, r0_up_point.Y - p0.Y, 2 * bb, 1);
    r0_low_point.X = p0.X + r1_tempoint.X;
    r0_low_point.Y = p0.Y + r1_tempoint.Y;


    l0 = new Line(r0_low_point, r1_up_point).ToNurbsCurve(); //!Clockwise one
    l1 = new Line(r0_up_point, r1_low_point).ToNurbsCurve();//!Anti-clockwise one


  }
  //点绕点旋转
  Point3d Transition(double _x, double _y, double _angle, int fx)
  {
    double newX = 0;
    double newY = 0;
    if (fx == 1)
    {
      newX = _x * Math.Cos(_angle) - _y * Math.Sin(_angle);
      newY = _x * Math.Sin(_angle) + _y * Math.Cos(_angle);
    }
    else
    {
      newX = _x * Math.Cos(_angle) + _y * Math.Sin(_angle);
      newY = _y * Math.Cos(_angle) - _x * Math.Sin(_angle);
    }
    return new Point3d(newX, newY, 0);
  }

  //! Line Line intersection by ChatGPT
  // Check if two lines intersect
  // The lines are defined by the points (x1, y1), (x2, y2)
  // and (x3, y3), (x4, y4) respectively
  // Returns true if the lines intersect, and false otherwise
  public static bool IsLineLineIntersect(Point3d p0, Point3d p1, Point3d p2, Point3d p3)
  {
    double x1 = p0.X;
    double y1 = p0.Y;
    double x2 = p1.X;
    double y2 = p1.Y;
    double x3 = p2.X;
    double y3 = p2.Y;
    double x4 = p3.X;
    double y4 = p3.Y;

    // Calculate the coefficients of the equations of the lines
    double a1 = y2 - y1;
    double b1 = x1 - x2;
    double c1 = a1 * x1 + b1 * y1;

    double a2 = y4 - y3;
    double b2 = x3 - x4;
    double c2 = a2 * x3 + b2 * y3;

    // Calculate the point of intersection
    double det = a1 * b2 - a2 * b1;
    if (det == 0)
    {
      // The lines are parallel
      return false;
    }
    else
    {
      double x = (b2 * c1 - b1 * c2) / det;
      double y = (a1 * c2 - a2 * c1) / det;

      // Check if the point of intersection is on both lines
      if ((x1 <= x && x <= x2 || x2 <= x && x <= x1) &&
          (x3 <= x && x <= x4 || x4 <= x && x <= x3) &&
          (y1 <= y && y <= y2 || y2 <= y && y <= y1) &&
          (y3 <= y && y <= y4 || y4 <= y && y <= y3))
      {
        // The lines intersect
        return true;
      }
      else
      {
        // The lines do not intersect
        return false;
      }
    }
  }


  //! Line side by ChatGPT
  public bool PointSideOfLine(Point3d p1, Point3d p2, Point3d p)
  {
    // Calculate the cross product of the two vectors determined by the three points.
    double crossProduct = (p2.X - p1.X) * (p.Y - p1.Y) - (p.X - p1.X) * (p2.Y - p1.Y);

    // If the cross product is positive, the point is on the left side of the line.
    if (crossProduct > 0)
    {
      return false; //left
    }
    // If the cross product is negative, the point is on the right side of the line.
    else
    {
      return true; //"right";
    }
  }
# ---------- end c_script_3 ----------
tree_branch = TreeBranch(Tree=simplify(circle), Path=number_slider_8, MaintainPaths=True)  # disabled
number_slider_9 = Slider(6, range=0..10)
join_curves = JoinCurves(Curves=c_script_3.OutTemp, Preserve=False)  # disabled
number_slider_10 = Slider(10, range=0..10)
loft = Loft(Curves=seam, Options={Adjust=False, Closed=False, LoftEnds=0, LoftSimp=1, LoftType=5, Rebuild=500, Refit=0.01})
division_3 = Division(A="1000", B=number_slider_9)
point_on_curve_2 = PointOnCurve(join_curves, parameter=1)  # disabled
point_on_curve_3 = PointOnCurve(join_curves, parameter=0)  # disabled
repeat_data = RepeatData(Data=number_slider_9, Length=division_3)
number_slider_11 = Slider(6, range=0..10)
number_slider_12 = Slider(10, range=0..10)
xz_plane = XZPlane(Origin=point_on_curve_3)  # disabled
yz_plane_2 = YZPlane(Origin=point_on_curve_2)  # disabled
contour_ex = ContourEx(Shape=loft, Plane=PlaneXY(0, 0, 0), Distances=repeat_data)  # -> flatten(Contours)
mirror = Mirror(Geometry=join_curves, Plane=xz_plane)  # -> Geometry, Transform; disabled
length = Length(Curve=contour_ex)
mirror_2 = Mirror(Geometry=mirror.Geometry, Plane=yz_plane_2)  # -> Geometry, Transform; disabled
mirror_3 = Mirror(Geometry=join_curves, Plane=yz_plane_2)  # -> Geometry, Transform; disabled
division_4 = Division(A=length, B=Slider(6, range=0..10))
merge = Merge(Data1=join_curves, Data2=mirror.Geometry, Data3=mirror_2.Geometry, Data4=mirror_3.Geometry)  # disabled
xy_plane = XYPlane(Origin=Point(0, 0, 0))  # disabled
divide_curve_2 = DivideCurve(Curve=contour_ex, Count=division_4, Kinks=False)  # -> Points, Tangents, Parameters
cluster = Cluster(curve=graft(merge))  # -> simplify(curves); disabled
path_mapper = PathMapper(cluster, source="{a;b}", target="{a}")  # disabled
boundary_surfaces = BoundarySurfaces(Edges=seam)
interpolate = Interpolate(Vertices=divide_curve_2.Points, Degree=3, Periodic=True, KnotStyle=1)  # -> flatten(Curve), Length, Domain
list_item_3 = ListItem(List=interpolate.Curve, Index=Slider(60, range=0..1000), Wrap=True)
curvature_graph = CurvatureGraph(Curve=list_item_3, Density=Slider(6, range=0..10), Scale=Slider(100, range=0..200))
curve_self = CurveSelf(Curve=list_item_3)  # -> Points, Params
region_union = RegionUnion(Curves=path_mapper, Plane=xy_plane)  # disabled
area_2 = Area(Geometry=region_union)  # -> Area, Centroid; disabled
loft_2 = Loft(
    Curves=interpolate.Curve,
    Options={Adjust=False, Closed=False, LoftEnds=0, LoftSimp=0, LoftType=0, Rebuild=10, Refit=0.01})
sort_list_2 = SortList(Keys=area_2.Area, ValuesValuesA=region_union)  # -> Keys, reverse(ValuesValuesA); disabled
series_4 = Series(Start=0, Step=layer_hight, Count=layer_number)  # disabled
list_item_4 = ListItem(List=sort_list_2.ValuesValuesA, Index=0, Wrap=True)  # disabled
unit_z = UnitZ(Factor=series_4)  # disabled
move_2 = Move(Geometry=list_item_4, Motion=graft(unit_z))  # -> flatten(Geometry), Transform; disabled
loft_3 = Loft(Curves=move_2.Geometry, Options={Adjust=False, Closed=False, LoftEnds=0, LoftSimp=0, LoftType=0, Rebuild=10, Refit=0.01})  # disabled

# ==== cluster Cluster
curve = ClusterInput()
curve_2 = Curve(curve)
point_on_curve = PointOnCurve(curve_2, parameter=1)
point_on_curve_2 = PointOnCurve(curve_2, parameter=0)
deconstruct = Deconstruct(Point=point_on_curve_2)  # -> XComponent, YComponent, ZComponent
deconstruct_2 = Deconstruct(Point=point_on_curve)  # -> XComponent, YComponent, ZComponent
construct_point = ConstructPoint(XCoordinate=deconstruct_2.XComponent, YCoordinate=deconstruct.YComponent, ZCoordinate=0)
line = Line(StartPoint=point_on_curve, EndPoint=construct_point)
line_2 = Line(StartPoint=point_on_curve_2, EndPoint=construct_point)
join_curves = JoinCurves(Curves=[line_2, curve_2, line], Preserve=False)
curves = ClusterOutput(join_curves)
